# Dynamo graph Interlude.Behavior.EnabledIf.dyn (Dynamo 4.2.0.5752)
# Interlude.Behavior.EnabledIf: a field that greys out until a condition holds.
# packages: Interlude 1.0.5

# group: Describe the field
# Greys the field out until the condition holds. The field stays on screen, which is the difference from VisibleIf: the user can see what is waiting on them.
code_block = CodeBlock { "Suffix"; "-REV"; ""; "suffix"; }
textBox = Interlude.Input.TextBox(label=code_block.out0, defaultValue=code_block.out1, placeholder=code_block.out2, key=code_block.out3)
code_block_2 = CodeBlock { "addSuffix"; }
isChecked = Interlude.Condition.IsChecked(key=code_block_2)
enabledIf = Interlude.Behavior.EnabledIf(element=textBox, condition=isChecked)

# group: Show it
# trigger is false so the graph runs without opening the dialog: every field comes back with its default and buttonClicked reads "skipped". Set it to true to see the form.
string = StringInput("Rename views")
code_block_3 = CodeBlock(field=enabledIf) { [field]; }
boolean = BoolSelector(false)
show = Interlude.Form.Show(title=string, elements=code_block_3, trigger=boolean)
string_2 = StringInput("suffix")

# group: Keep it as a document
# Form.Create builds the same form without showing it, and Form.ToJson writes it out. A form saved this way can be reviewed, diffed and loaded again with Form.FromJson.
create = Interlude.Form.Create(title=string, elements=code_block_3)
toJson = Interlude.Form.ToJson(form=create)

# group: Read the answer
# Answers come back keyed by the field's key, whatever the form looked like.
getString = Interlude.Result.GetString(result=show.form, key=string_2)
