# Dynamo graph Interlude.Behavior.ReadOnly.dyn (Dynamo 4.2.0.5752)
# Interlude.Behavior.ReadOnly: a field shown but not editable.
# packages: Interlude 1.0.4

# group: Describe the field
# Shown but not editable. The answer still comes back, which is the point: it carries a value the graph worked out into the results without letting anyone change it.
code_block = CodeBlock { "Model path"; "C:/Projects/TowerA.rvt"; ""; "modelPath"; }
textBox = Interlude.Input.TextBox(label=code_block.out0, defaultValue=code_block.out1, placeholder=code_block.out2, key=code_block.out3)
code_block_2 = CodeBlock { true; }
readOnly = Interlude.Behavior.ReadOnly(element=textBox, readOnly=code_block_2)

# group: Show it
# trigger is false so the graph runs without opening the dialog: every field comes back with its default and buttonClicked reads "skipped". Set it to true to see the form.
string = StringInput("Site survey")
code_block_3 = CodeBlock(field=readOnly) { [field]; }
boolean = BoolSelector(false)
show = Interlude.Form.Show(title=string, elements=code_block_3, trigger=boolean)
string_2 = StringInput("modelPath")

# group: Keep it as a document
# Form.Create builds the same form without showing it, and Form.ToJson writes it out. A form saved this way can be reviewed, diffed and loaded again with Form.FromJson.
create = Interlude.Form.Create(title=string, elements=code_block_3)
toJson = Interlude.Form.ToJson(form=create)

# group: Read the answer
# Answers come back keyed by the field's key, whatever the form looked like.
getString = Interlude.Result.GetString(result=show.form, key=string_2)
