# Dynamo graph Interlude.Behavior.Required.dyn (Dynamo 4.2.0.5752)
# Interlude.Behavior.Required: a field that must be answered before the form submits.
# packages: Interlude 1.1.1

# group: Describe the field
# The field must be answered. The message is what the user sees when it is not; write it as the thing to do rather than as the thing that went wrong.
code_block = CodeBlock { "Project name"; ""; "Required"; "projectName"; }
textBox = Interlude.Input.TextBox(label=code_block.out0, defaultValue=code_block.out1, placeholder=code_block.out2, key=code_block.out3)
code_block_2 = CodeBlock { "A project name is needed"; }
required = Interlude.Behavior.Required(element=textBox, message=code_block_2)

# group: Show it
# trigger is false so the graph runs without opening the dialog: every field comes back with its default and buttonClicked reads "skipped". Set it to true to see the form.
string = StringInput("Site survey")
code_block_3 = CodeBlock(field=required) { [field]; }
boolean = BoolSelector(false)
show = Interlude.Form.Show(title=string, elements=code_block_3, trigger=boolean)
string_2 = StringInput("projectName")

# group: Keep it as a document
# Form.Create builds the same form without showing it, and Form.ToJson writes it out. A form saved this way can be reviewed, diffed and loaded again with Form.FromJson.
create = Interlude.Form.Create(title=string, elements=code_block_3)
toJson = Interlude.Form.ToJson(form=create)

# group: Read the answer
# Answers come back keyed by the field's key, whatever the form looked like.
getString = Interlude.Result.GetString(result=show.form, key=string_2)
