# Dynamo graph Interlude.Behavior.RequiredIf.dyn (Dynamo 4.2.0.5752)
# Interlude.Behavior.RequiredIf: a field required only when a condition holds.
# packages: Interlude 1.0.5

# group: Describe the field
# Required, but only sometimes. The field can be left empty until the condition holds, at which point the form will not submit without it.
code_block = CodeBlock { "Reason"; ""; "Why the override is needed"; "reason"; }
textBox = Interlude.Input.TextBox(label=code_block.out0, defaultValue=code_block.out1, placeholder=code_block.out2, key=code_block.out3)
code_block_2 = CodeBlock { "override"; }
isChecked = Interlude.Condition.IsChecked(key=code_block_2)
code_block_3 = CodeBlock { "Say why the override is needed"; }
requiredIf = Interlude.Behavior.RequiredIf(element=textBox, condition=isChecked, message=code_block_3)

# group: Show it
# trigger is false so the graph runs without opening the dialog: every field comes back with its default and buttonClicked reads "skipped". Set it to true to see the form.
string = StringInput("Model audit")
code_block_4 = CodeBlock(field=requiredIf) { [field]; }
boolean = BoolSelector(false)
show = Interlude.Form.Show(title=string, elements=code_block_4, trigger=boolean)
string_2 = StringInput("reason")

# group: Keep it as a document
# Form.Create builds the same form without showing it, and Form.ToJson writes it out. A form saved this way can be reviewed, diffed and loaded again with Form.FromJson.
create = Interlude.Form.Create(title=string, elements=code_block_4)
toJson = Interlude.Form.ToJson(form=create)

# group: Read the answer
# Answers come back keyed by the field's key, whatever the form looked like.
getString = Interlude.Result.GetString(result=show.form, key=string_2)
