# Dynamo graph Interlude.Behavior.VisibleIf.dyn (Dynamo 4.2.0.5752)
# Interlude.Behavior.VisibleIf: a field that appears only when a condition holds.
# packages: Interlude 1.0.5

# group: Describe the field
# Hides the field until the condition holds, and the form resizes around it. A hidden field still answers with its default, so the results have the same shape either way.
code_block = CodeBlock { "Sheet prefix"; "A-"; ""; "sheetPrefix"; }
textBox = Interlude.Input.TextBox(label=code_block.out0, defaultValue=code_block.out1, placeholder=code_block.out2, key=code_block.out3)
code_block_2 = CodeBlock { "scope"; "sheets"; true; }
equals = Interlude.Condition.Equals(key=code_block_2.out0, value=code_block_2.out1, ignoreCase=code_block_2.out2)
visibleIf = Interlude.Behavior.VisibleIf(element=textBox, condition=equals)

# group: Show it
# trigger is false so the graph runs without opening the dialog: every field comes back with its default and buttonClicked reads "skipped". Set it to true to see the form.
string = StringInput("Export")
code_block_3 = CodeBlock(field=visibleIf) { [field]; }
boolean = BoolSelector(false)
show = Interlude.Form.Show(title=string, elements=code_block_3, trigger=boolean)
string_2 = StringInput("sheetPrefix")

# group: Keep it as a document
# Form.Create builds the same form without showing it, and Form.ToJson writes it out. A form saved this way can be reviewed, diffed and loaded again with Form.FromJson.
create = Interlude.Form.Create(title=string, elements=code_block_3)
toJson = Interlude.Form.ToJson(form=create)

# group: Read the answer
# Answers come back keyed by the field's key, whatever the form looked like.
getString = Interlude.Result.GetString(result=show.form, key=string_2)
