# Dynamo graph Interlude.Behavior.WithComputed.dyn (Dynamo 4.2.0.5752)
# Interlude.Behavior.WithComputed: a field whose value is worked out from the others.
# packages: Interlude 1.0.5

# group: Describe the field
# The value is worked out from other fields and recalculated as they change. Only inputs can carry one: a computed value writes into an answer, and a display element has no answer to write into.
code_block = CodeBlock { "New name"; ""; "Worked out below"; "newName"; }
textBox = Interlude.Input.TextBox(label=code_block.out0, defaultValue=code_block.out1, placeholder=code_block.out2, key=code_block.out3)
code_block_2 = CodeBlock { "{prefix}-{level}-101"; }
format = Interlude.Compute.Format(template=code_block_2)
withComputed = Interlude.Behavior.WithComputed(element=textBox, computation=format)

# group: Show it
# trigger is false so the graph runs without opening the dialog: every field comes back with its default and buttonClicked reads "skipped". Set it to true to see the form.
string = StringInput("Rename views")
code_block_3 = CodeBlock(field=withComputed) { [field]; }
boolean = BoolSelector(false)
show = Interlude.Form.Show(title=string, elements=code_block_3, trigger=boolean)
string_2 = StringInput("newName")

# group: Keep it as a document
# Form.Create builds the same form without showing it, and Form.ToJson writes it out. A form saved this way can be reviewed, diffed and loaded again with Form.FromJson.
create = Interlude.Form.Create(title=string, elements=code_block_3)
toJson = Interlude.Form.ToJson(form=create)

# group: Read the answer
# Answers come back keyed by the field's key, whatever the form looked like.
getString = Interlude.Result.GetString(result=show.form, key=string_2)
