# Dynamo graph Interlude.Behavior.WithKey.dyn (Dynamo 4.2.0.5752)
# Interlude.Behavior.WithKey: names the answer a field comes back under.
# packages: Interlude 1.0.4

# group: Describe the field
# Names the answer. A field with no key gets one derived from its label, which is fine until someone rewords the label and every graph reading that answer stops finding it.
code_block = CodeBlock { "Project name"; "Tower A"; }
textBox = Interlude.Input.TextBox(label=code_block.out0, defaultValue=code_block.out1)
code_block_2 = CodeBlock { "projectName"; }
withKey = Interlude.Behavior.WithKey(element=textBox, key=code_block_2)

# group: Show it
# trigger is false so the graph runs without opening the dialog: every field comes back with its default and buttonClicked reads "skipped". Set it to true to see the form.
string = StringInput("Site survey")
code_block_3 = CodeBlock(field=withKey) { [field]; }
boolean = BoolSelector(false)
show = Interlude.Form.Show(title=string, elements=code_block_3, trigger=boolean)
string_2 = StringInput("projectName")

# group: Keep it as a document
# Form.Create builds the same form without showing it, and Form.ToJson writes it out. A form saved this way can be reviewed, diffed and loaded again with Form.FromJson.
create = Interlude.Form.Create(title=string, elements=code_block_3)
toJson = Interlude.Form.ToJson(form=create)

# group: Read the answer
# Answers come back keyed by the field's key, whatever the form looked like.
getString = Interlude.Result.GetString(result=show.form, key=string_2)
