# Dynamo graph Interlude.Behavior.WithSize.dyn (Dynamo 4.2.0.5752)
# Interlude.Behavior.WithSize: overrides the width, height, label column or margin of one field.
# packages: Interlude 1.0.5

# group: Describe the field
# Sizes one field against the theme's defaults. Every port takes null to mean leave it alone, so a graph can set the label column without also fixing the height.
code_block = CodeBlock { "Reference"; "AB-1234"; ""; "reference"; }
textBox = Interlude.Input.TextBox(label=code_block.out0, defaultValue=code_block.out1, placeholder=code_block.out2, key=code_block.out3)
code_block_2 = CodeBlock { 240; null; 90; null; }
withSize = Interlude.Behavior.WithSize(element=textBox, width=code_block_2.out0, height=code_block_2.out1, labelWidth=code_block_2.out2, margin=code_block_2.out3)

# group: Show it
# trigger is false so the graph runs without opening the dialog: every field comes back with its default and buttonClicked reads "skipped". Set it to true to see the form.
string = StringInput("Site survey")
code_block_3 = CodeBlock(field=withSize) { [field]; }
boolean = BoolSelector(false)
show = Interlude.Form.Show(title=string, elements=code_block_3, trigger=boolean)
string_2 = StringInput("reference")

# group: Keep it as a document
# Form.Create builds the same form without showing it, and Form.ToJson writes it out. A form saved this way can be reviewed, diffed and loaded again with Form.FromJson.
create = Interlude.Form.Create(title=string, elements=code_block_3)
toJson = Interlude.Form.ToJson(form=create)

# group: Read the answer
# Answers come back keyed by the field's key, whatever the form looked like.
getString = Interlude.Result.GetString(result=show.form, key=string_2)
