# Dynamo graph Interlude.Compute.Arithmetic.dyn (Dynamo 4.2.0.5752)
# Interlude.Compute.Arithmetic: two values combined arithmetically.
# packages: Interlude 1.1.1

# group: Describe the field
# Each side is a field key, a literal, or another computation — which is how a longer expression is built, by nesting one of these inside the next. Dividing by zero gives zero rather than infinity, so a half-filled form shows a number instead of a symbol.
code_block = CodeBlock { "Floor area"; 240.0; 0; 10000; 1.0; 1; "m²"; "floorArea"; }
number = Interlude.Input.Number(label=code_block.out0, defaultValue=code_block.out1, minimum=code_block.out2, maximum=code_block.out3, increment=code_block.out4, decimalPlaces=code_block.out5, unit=code_block.out6, key=code_block.out7)
code_block_2 = CodeBlock { "Storeys"; 12; 1; 60; 1; ""; "storeys"; }
integer = Interlude.Input.Integer(label=code_block_2.out0, defaultValue=code_block_2.out1, minimum=code_block_2.out2, maximum=code_block_2.out3, increment=code_block_2.out4, unit=code_block_2.out5, key=code_block_2.out6)
code_block_3 = CodeBlock { "Gross area"; 0.0; 0; 1000000; 1.0; 1; "m²"; "grossArea"; }
number_2 = Interlude.Input.Number(label=code_block_3.out0, defaultValue=code_block_3.out1, minimum=code_block_3.out2, maximum=code_block_3.out3, increment=code_block_3.out4, decimalPlaces=code_block_3.out5, unit=code_block_3.out6, key=code_block_3.out7)
code_block_4 = CodeBlock { "floorArea"; "Multiply"; "storeys"; }
arithmetic = Interlude.Compute.Arithmetic(left=code_block_4.out0, operation=code_block_4.out1, right=code_block_4.out2)
withComputed = Interlude.Behavior.WithComputed(element=number_2, computation=arithmetic)
code_block_5 = CodeBlock(child0=number, child1=integer, child2=withComputed) { [child0,child1,child2]; }
code_block_6 = CodeBlock { 8.0; }
column = Interlude.Layout.Column(elements=code_block_5, spacing=code_block_6)

# group: Show it
# trigger is false so the graph runs without opening the dialog: every field comes back with its default and buttonClicked reads "skipped". Set it to true to see the form.
string = StringInput("Site survey")
code_block_7 = CodeBlock(field=column) { [field]; }
boolean = BoolSelector(false)
show = Interlude.Form.Show(title=string, elements=code_block_7, trigger=boolean)
string_2 = StringInput("grossArea")

# group: Keep it as a document
# Form.Create builds the same form without showing it, and Form.ToJson writes it out. A form saved this way can be reviewed, diffed and loaded again with Form.FromJson.
create = Interlude.Form.Create(title=string, elements=code_block_7)
toJson = Interlude.Form.ToJson(form=create)

# group: Read the answer
# Answers come back keyed by the field's key, whatever the form looked like.
getNumber = Interlude.Result.GetNumber(result=show.form, key=string_2)
