# Dynamo graph Interlude.Compute.Constant.dyn (Dynamo 4.2.0.5752)
# Interlude.Compute.Constant: a fixed value that never changes.
# packages: Interlude 1.0.4

# group: Describe the field
# A field the user can see but not set. Useful as a branch of Compute.If, and useful on its own to show a settled value in the form rather than leaving it implicit in the graph.
code_block = CodeBlock { "Paper size"; ["A1","A3"]; ["A1","A3"]; "A1"; "Pick one"; "paperSize"; }
dropDown = Interlude.Input.DropDown(label=code_block.out0, items=code_block.out1, displayNames=code_block.out2, defaultValue=code_block.out3, placeholder=code_block.out4, key=code_block.out5)
code_block_2 = CodeBlock { "Plot driver"; ""; "Fixed by the practice standard"; "plotDriver"; }
textBox = Interlude.Input.TextBox(label=code_block_2.out0, defaultValue=code_block_2.out1, placeholder=code_block_2.out2, key=code_block_2.out3)
code_block_3 = CodeBlock { "PDF24"; }
constant = Interlude.Compute.Constant(value=code_block_3)
withComputed = Interlude.Behavior.WithComputed(element=textBox, computation=constant)
code_block_4 = CodeBlock(child0=dropDown, child1=withComputed) { [child0,child1]; }
code_block_5 = CodeBlock { 8.0; }
column = Interlude.Layout.Column(elements=code_block_4, spacing=code_block_5)

# group: Show it
# trigger is false so the graph runs without opening the dialog: every field comes back with its default and buttonClicked reads "skipped". Set it to true to see the form.
string = StringInput("Export")
code_block_6 = CodeBlock(field=column) { [field]; }
boolean = BoolSelector(false)
show = Interlude.Form.Show(title=string, elements=code_block_6, trigger=boolean)
string_2 = StringInput("plotDriver")

# group: Keep it as a document
# Form.Create builds the same form without showing it, and Form.ToJson writes it out. A form saved this way can be reviewed, diffed and loaded again with Form.FromJson.
create = Interlude.Form.Create(title=string, elements=code_block_6)
toJson = Interlude.Form.ToJson(form=create)

# group: Read the answer
# Answers come back keyed by the field's key, whatever the form looked like.
getString = Interlude.Result.GetString(result=show.form, key=string_2)
