# Dynamo graph Interlude.Compute.Field.dyn (Dynamo 4.2.0.5752)
# Interlude.Compute.Field: the current answer of another field.
# packages: Interlude 1.1.1

# group: Describe the field
# One field mirroring another, and the building block the other Compute nodes are made of: wherever one of them takes a value, a key names a field and this is what reading it looks like on its own.
code_block = CodeBlock { "View name"; "Level 01 - Plan"; ""; "viewName"; }
textBox = Interlude.Input.TextBox(label=code_block.out0, defaultValue=code_block.out1, placeholder=code_block.out2, key=code_block.out3)
code_block_2 = CodeBlock { "Sheet title"; ""; "Copied from the view name"; "sheetTitle"; }
textBox_2 = Interlude.Input.TextBox(label=code_block_2.out0, defaultValue=code_block_2.out1, placeholder=code_block_2.out2, key=code_block_2.out3)
code_block_3 = CodeBlock { "viewName"; }
field = Interlude.Compute.Field(key=code_block_3)
withComputed = Interlude.Behavior.WithComputed(element=textBox_2, computation=field)
code_block_4 = CodeBlock(child0=textBox, child1=withComputed) { [child0,child1]; }
code_block_5 = CodeBlock { 8.0; }
column = Interlude.Layout.Column(elements=code_block_4, spacing=code_block_5)

# group: Show it
# trigger is false so the graph runs without opening the dialog: every field comes back with its default and buttonClicked reads "skipped". Set it to true to see the form.
string = StringInput("Rename views")
code_block_6 = CodeBlock(field=column) { [field]; }
boolean = BoolSelector(false)
show = Interlude.Form.Show(title=string, elements=code_block_6, trigger=boolean)
string_2 = StringInput("sheetTitle")

# group: Keep it as a document
# Form.Create builds the same form without showing it, and Form.ToJson writes it out. A form saved this way can be reviewed, diffed and loaded again with Form.FromJson.
create = Interlude.Form.Create(title=string, elements=code_block_6)
toJson = Interlude.Form.ToJson(form=create)

# group: Read the answer
# Answers come back keyed by the field's key, whatever the form looked like.
getString = Interlude.Result.GetString(result=show.form, key=string_2)
