# Dynamo graph Interlude.Compute.Format.dyn (Dynamo 4.2.0.5752)
# Interlude.Compute.Format: builds a string from other fields as they are typed.
# packages: Interlude 1.0.4

# group: Describe the field
# A computed value is an ingredient: Behavior.WithComputed is what attaches it to a field. Each {name} in the template is a field key, replaced as that field changes, so the answer recalculates while the user types.
code_block = CodeBlock { "Prefix"; "L01"; ""; "prefix"; }
textBox = Interlude.Input.TextBox(label=code_block.out0, defaultValue=code_block.out1, placeholder=code_block.out2, key=code_block.out3)
code_block_2 = CodeBlock { "New name"; ""; "Worked out from the prefix"; "newName"; }
textBox_2 = Interlude.Input.TextBox(label=code_block_2.out0, defaultValue=code_block_2.out1, placeholder=code_block_2.out2, key=code_block_2.out3)
code_block_3 = CodeBlock { "{prefix}-A-101"; }
format = Interlude.Compute.Format(template=code_block_3)
withComputed = Interlude.Behavior.WithComputed(element=textBox_2, computation=format)
code_block_4 = CodeBlock(child0=textBox, child1=withComputed) { [child0,child1]; }
code_block_5 = CodeBlock { 8.0; }
column = Interlude.Layout.Column(elements=code_block_4, spacing=code_block_5)

# group: Show it
# trigger is false so the graph runs without opening the dialog: every field comes back with its default and buttonClicked reads "skipped". Set it to true to see the form.
string = StringInput("Rename views")
code_block_6 = CodeBlock(field=column) { [field]; }
boolean = BoolSelector(false)
show = Interlude.Form.Show(title=string, elements=code_block_6, trigger=boolean)
string_2 = StringInput("newName")

# group: Keep it as a document
# Form.Create builds the same form without showing it, and Form.ToJson writes it out. A form saved this way can be reviewed, diffed and loaded again with Form.FromJson.
create = Interlude.Form.Create(title=string, elements=code_block_6)
toJson = Interlude.Form.ToJson(form=create)

# group: Read the answer
# Answers come back keyed by the field's key, whatever the form looked like.
getString = Interlude.Result.GetString(result=show.form, key=string_2)
