# Dynamo graph Interlude.Compute.If.dyn (Dynamo 4.2.0.5752)
# Interlude.Compute.If: one of two values, chosen by a condition.
# packages: Interlude 1.0.5

# group: Describe the field
# The Condition nodes reused for a value rather than for visibility. Either branch takes another computation, so a chain of these is how a form expresses a decision table.
code_block = CodeBlock { "Export to PDF"; true; "toPdf"; }
checkBox = Interlude.Input.CheckBox(label=code_block.out0, defaultValue=code_block.out1, key=code_block.out2)
code_block_2 = CodeBlock { "File extension"; ""; "Follows the tick box"; "extension"; }
textBox = Interlude.Input.TextBox(label=code_block_2.out0, defaultValue=code_block_2.out1, placeholder=code_block_2.out2, key=code_block_2.out3)
code_block_3 = CodeBlock { "toPdf"; }
isChecked = Interlude.Condition.IsChecked(key=code_block_3)
code_block_4 = CodeBlock { ".pdf"; ".dwg"; }
if_ = Interlude.Compute.If(condition=isChecked, ifTrue=code_block_4.out0, ifFalse=code_block_4.out1)
withComputed = Interlude.Behavior.WithComputed(element=textBox, computation=if_)
code_block_5 = CodeBlock(child0=checkBox, child1=withComputed) { [child0,child1]; }
code_block_6 = CodeBlock { 8.0; }
column = Interlude.Layout.Column(elements=code_block_5, spacing=code_block_6)

# group: Show it
# trigger is false so the graph runs without opening the dialog: every field comes back with its default and buttonClicked reads "skipped". Set it to true to see the form.
string = StringInput("Export")
code_block_7 = CodeBlock(field=column) { [field]; }
boolean = BoolSelector(false)
show = Interlude.Form.Show(title=string, elements=code_block_7, trigger=boolean)
string_2 = StringInput("extension")

# group: Keep it as a document
# Form.Create builds the same form without showing it, and Form.ToJson writes it out. A form saved this way can be reviewed, diffed and loaded again with Form.FromJson.
create = Interlude.Form.Create(title=string, elements=code_block_7)
toJson = Interlude.Form.ToJson(form=create)

# group: Read the answer
# Answers come back keyed by the field's key, whatever the form looked like.
getString = Interlude.Result.GetString(result=show.form, key=string_2)
