# Dynamo graph Interlude.Compute.Sum.dyn (Dynamo 4.2.0.5752)
# Interlude.Compute.Sum: several fields added together.
# packages: Interlude 1.0.4

# group: Describe the field
# Anything that is not a number counts as zero, so a half-filled form shows a running total rather than an error, and a multi-select of numbers adds up its own items.
code_block = CodeBlock { "Sheets"; 12; 0; 500; 1; ""; "sheets"; }
integer = Interlude.Input.Integer(label=code_block.out0, defaultValue=code_block.out1, minimum=code_block.out2, maximum=code_block.out3, increment=code_block.out4, unit=code_block.out5, key=code_block.out6)
code_block_2 = CodeBlock { "Views"; 8; 0; 500; 1; ""; "views"; }
integer_2 = Interlude.Input.Integer(label=code_block_2.out0, defaultValue=code_block_2.out1, minimum=code_block_2.out2, maximum=code_block_2.out3, increment=code_block_2.out4, unit=code_block_2.out5, key=code_block_2.out6)
code_block_3 = CodeBlock { "Total to export"; 0; 0; 1000; 1; ""; "total"; }
integer_3 = Interlude.Input.Integer(label=code_block_3.out0, defaultValue=code_block_3.out1, minimum=code_block_3.out2, maximum=code_block_3.out3, increment=code_block_3.out4, unit=code_block_3.out5, key=code_block_3.out6)
code_block_4 = CodeBlock { ["sheets","views"]; }
sum = Interlude.Compute.Sum(keys=code_block_4)
withComputed = Interlude.Behavior.WithComputed(element=integer_3, computation=sum)
code_block_5 = CodeBlock(child0=integer, child1=integer_2, child2=withComputed) { [child0,child1,child2]; }
code_block_6 = CodeBlock { 8.0; }
column = Interlude.Layout.Column(elements=code_block_5, spacing=code_block_6)

# group: Show it
# trigger is false so the graph runs without opening the dialog: every field comes back with its default and buttonClicked reads "skipped". Set it to true to see the form.
string = StringInput("Export")
code_block_7 = CodeBlock(field=column) { [field]; }
boolean = BoolSelector(false)
show = Interlude.Form.Show(title=string, elements=code_block_7, trigger=boolean)
string_2 = StringInput("total")

# group: Keep it as a document
# Form.Create builds the same form without showing it, and Form.ToJson writes it out. A form saved this way can be reviewed, diffed and loaded again with Form.FromJson.
create = Interlude.Form.Create(title=string, elements=code_block_7)
toJson = Interlude.Form.ToJson(form=create)

# group: Read the answer
# Answers come back keyed by the field's key, whatever the form looked like.
getInteger = Interlude.Result.GetInteger(result=show.form, key=string_2)
