# Dynamo graph Interlude.Condition.Always.dyn (Dynamo 4.2.0.5752)
# Interlude.Condition.Always: true or false regardless of what the form says.
# packages: Interlude 1.0.5

# group: Describe the field
# A constant, for a condition wired from the graph rather than from the form — a boolean worked out upstream, or a placeholder while a form is being built. Set value to false and whatever it controls disappears.
code_block = CodeBlock { "Include linked models"; true; "includeLinks"; }
checkBox = Interlude.Input.CheckBox(label=code_block.out0, defaultValue=code_block.out1, key=code_block.out2)
code_block_2 = CodeBlock { "Report name"; "Audit"; ""; "reportName"; }
textBox = Interlude.Input.TextBox(label=code_block_2.out0, defaultValue=code_block_2.out1, placeholder=code_block_2.out2, key=code_block_2.out3)
code_block_3 = CodeBlock { true; }
always = Interlude.Condition.Always(value=code_block_3)
visibleIf = Interlude.Behavior.VisibleIf(element=textBox, condition=always)
code_block_4 = CodeBlock(child0=checkBox, child1=visibleIf) { [child0,child1]; }
code_block_5 = CodeBlock { 8.0; }
column = Interlude.Layout.Column(elements=code_block_4, spacing=code_block_5)

# group: Show it
# trigger is false so the graph runs without opening the dialog: every field comes back with its default and buttonClicked reads "skipped". Set it to true to see the form.
string = StringInput("Model audit")
code_block_6 = CodeBlock(field=column) { [field]; }
boolean = BoolSelector(false)
show = Interlude.Form.Show(title=string, elements=code_block_6, trigger=boolean)
string_2 = StringInput("reportName")

# group: Keep it as a document
# Form.Create builds the same form without showing it, and Form.ToJson writes it out. A form saved this way can be reviewed, diffed and loaded again with Form.FromJson.
create = Interlude.Form.Create(title=string, elements=code_block_6)
toJson = Interlude.Form.ToJson(form=create)

# group: Read the answer
# Answers come back keyed by the field's key, whatever the form looked like.
getString = Interlude.Result.GetString(result=show.form, key=string_2)
