# Dynamo graph Interlude.Condition.And.dyn (Dynamo 4.2.0.5752)
# Interlude.Condition.And: true while every one of several conditions is true.
# packages: Interlude 1.0.4

# group: Describe the field
# Conditions nest, so an And can hold an Or which holds comparisons. An empty list is true, which means a condition assembled from a list that happened to come back empty lets everything through rather than nothing.
code_block = CodeBlock { "Add a suffix"; true; "addSuffix"; }
checkBox = Interlude.Input.CheckBox(label=code_block.out0, defaultValue=code_block.out1, key=code_block.out2)
code_block_2 = CodeBlock { "Suffix"; "-REV"; ""; "suffix"; }
textBox = Interlude.Input.TextBox(label=code_block_2.out0, defaultValue=code_block_2.out1, placeholder=code_block_2.out2, key=code_block_2.out3)
code_block_3 = CodeBlock { "Apply to sheets as well"; true; "alsoSheets"; }
checkBox_2 = Interlude.Input.CheckBox(label=code_block_3.out0, defaultValue=code_block_3.out1, key=code_block_3.out2)
code_block_4 = CodeBlock { "addSuffix"; }
isChecked = Interlude.Condition.IsChecked(key=code_block_4)
code_block_5 = CodeBlock { "suffix"; }
isNotEmpty = Interlude.Condition.IsNotEmpty(key=code_block_5)
code_block_6 = CodeBlock(child0=isChecked, child1=isNotEmpty) { [child0,child1]; }
and_ = Interlude.Condition.And(conditions=code_block_6)
visibleIf = Interlude.Behavior.VisibleIf(element=checkBox_2, condition=and_)
code_block_7 = CodeBlock(child0=checkBox, child1=textBox, child2=visibleIf) { [child0,child1,child2]; }
code_block_8 = CodeBlock { 8.0; }
column = Interlude.Layout.Column(elements=code_block_7, spacing=code_block_8)

# group: Show it
# trigger is false so the graph runs without opening the dialog: every field comes back with its default and buttonClicked reads "skipped". Set it to true to see the form.
string = StringInput("Rename views")
code_block_9 = CodeBlock(field=column) { [field]; }
boolean = BoolSelector(false)
show = Interlude.Form.Show(title=string, elements=code_block_9, trigger=boolean)
string_2 = StringInput()

# group: Keep it as a document
# Form.Create builds the same form without showing it, and Form.ToJson writes it out. A form saved this way can be reviewed, diffed and loaded again with Form.FromJson.
create = Interlude.Form.Create(title=string, elements=code_block_9)
toJson = Interlude.Form.ToJson(form=create)

# group: Read the answer
# Answers come back keyed by the field's key, whatever the form looked like.
getString = Interlude.Result.GetString(result=show.form, key=string_2)
