# Dynamo graph Interlude.Condition.Contains.dyn (Dynamo 4.2.0.5752)
# Interlude.Condition.Contains: true while a field holds the value somewhere inside it.
# packages: Interlude 1.0.5

# group: Describe the field
# A substring for text, and membership for a list — so the same node asks "does this name mention Plan" and "is this one of the levels ticked", depending on what the field is.
code_block = CodeBlock { "View name"; "Level 01 - Plan"; ""; "viewName"; }
textBox = Interlude.Input.TextBox(label=code_block.out0, defaultValue=code_block.out1, placeholder=code_block.out2, key=code_block.out3)
code_block_2 = CodeBlock { "Plan scale"; "1:100"; ""; "planScale"; }
textBox_2 = Interlude.Input.TextBox(label=code_block_2.out0, defaultValue=code_block_2.out1, placeholder=code_block_2.out2, key=code_block_2.out3)
code_block_3 = CodeBlock { "viewName"; "Plan"; true; }
contains = Interlude.Condition.Contains(key=code_block_3.out0, value=code_block_3.out1, ignoreCase=code_block_3.out2)
visibleIf = Interlude.Behavior.VisibleIf(element=textBox_2, condition=contains)
code_block_4 = CodeBlock(child0=textBox, child1=visibleIf) { [child0,child1]; }
code_block_5 = CodeBlock { 8.0; }
column = Interlude.Layout.Column(elements=code_block_4, spacing=code_block_5)

# group: Show it
# trigger is false so the graph runs without opening the dialog: every field comes back with its default and buttonClicked reads "skipped". Set it to true to see the form.
string = StringInput("Rename views")
code_block_6 = CodeBlock(field=column) { [field]; }
boolean = BoolSelector(false)
show = Interlude.Form.Show(title=string, elements=code_block_6, trigger=boolean)
string_2 = StringInput("planScale")

# group: Keep it as a document
# Form.Create builds the same form without showing it, and Form.ToJson writes it out. A form saved this way can be reviewed, diffed and loaded again with Form.FromJson.
create = Interlude.Form.Create(title=string, elements=code_block_6)
toJson = Interlude.Form.ToJson(form=create)

# group: Read the answer
# Answers come back keyed by the field's key, whatever the form looked like.
getString = Interlude.Result.GetString(result=show.form, key=string_2)
