# Dynamo graph Interlude.Condition.EndsWith.dyn (Dynamo 4.2.0.5752)
# Interlude.Condition.EndsWith: true while a field ends with the value.
# packages: Interlude 1.0.4

# group: Describe the field
# Extensions are the usual reason to ask. ignoreCase matters more here than elsewhere, because a file picked off disk arrives with whatever case it was saved with.
code_block = CodeBlock { "Output file"; "model.rvt"; ""; "outputFile"; }
textBox = Interlude.Input.TextBox(label=code_block.out0, defaultValue=code_block.out1, placeholder=code_block.out2, key=code_block.out3)
code_block_2 = CodeBlock { "Detach from central"; true; "detach"; }
checkBox = Interlude.Input.CheckBox(label=code_block_2.out0, defaultValue=code_block_2.out1, key=code_block_2.out2)
code_block_3 = CodeBlock { "outputFile"; ".rvt"; true; }
endsWith = Interlude.Condition.EndsWith(key=code_block_3.out0, value=code_block_3.out1, ignoreCase=code_block_3.out2)
visibleIf = Interlude.Behavior.VisibleIf(element=checkBox, condition=endsWith)
code_block_4 = CodeBlock(child0=textBox, child1=visibleIf) { [child0,child1]; }
code_block_5 = CodeBlock { 8.0; }
column = Interlude.Layout.Column(elements=code_block_4, spacing=code_block_5)

# group: Show it
# trigger is false so the graph runs without opening the dialog: every field comes back with its default and buttonClicked reads "skipped". Set it to true to see the form.
string = StringInput("Export")
code_block_6 = CodeBlock(field=column) { [field]; }
boolean = BoolSelector(false)
show = Interlude.Form.Show(title=string, elements=code_block_6, trigger=boolean)
string_2 = StringInput()

# group: Keep it as a document
# Form.Create builds the same form without showing it, and Form.ToJson writes it out. A form saved this way can be reviewed, diffed and loaded again with Form.FromJson.
create = Interlude.Form.Create(title=string, elements=code_block_6)
toJson = Interlude.Form.ToJson(form=create)

# group: Read the answer
# Answers come back keyed by the field's key, whatever the form looked like.
getString = Interlude.Result.GetString(result=show.form, key=string_2)
