# Dynamo graph Interlude.Condition.In.dyn (Dynamo 4.2.0.5752)
# Interlude.Condition.In: true while a field holds one of several values.
# packages: Interlude 1.1.1

# group: Describe the field
# A list of Condition.Equals folded into one node. Where a form would otherwise grow an Or of three comparisons, this says the same thing in a single port.
code_block = CodeBlock { "Discipline"; ["ARC","STR","MEP"]; ["Architectural","Structural","Services"]; "STR"; "Pick one"; "discipline"; }
dropDown = Interlude.Input.DropDown(label=code_block.out0, items=code_block.out1, displayNames=code_block.out2, defaultValue=code_block.out3, placeholder=code_block.out4, key=code_block.out5)
code_block_2 = CodeBlock { "Load case"; "LC1"; ""; "loadCase"; }
textBox = Interlude.Input.TextBox(label=code_block_2.out0, defaultValue=code_block_2.out1, placeholder=code_block_2.out2, key=code_block_2.out3)
code_block_3 = CodeBlock { "discipline"; ["STR","MEP"]; true; }
in_ = Interlude.Condition.In(key=code_block_3.out0, values=code_block_3.out1, ignoreCase=code_block_3.out2)
visibleIf = Interlude.Behavior.VisibleIf(element=textBox, condition=in_)
code_block_4 = CodeBlock(child0=dropDown, child1=visibleIf) { [child0,child1]; }
code_block_5 = CodeBlock { 8.0; }
column = Interlude.Layout.Column(elements=code_block_4, spacing=code_block_5)

# group: Show it
# trigger is false so the graph runs without opening the dialog: every field comes back with its default and buttonClicked reads "skipped". Set it to true to see the form.
string = StringInput("Site survey")
code_block_6 = CodeBlock(field=column) { [field]; }
boolean = BoolSelector(false)
show = Interlude.Form.Show(title=string, elements=code_block_6, trigger=boolean)
string_2 = StringInput("loadCase")

# group: Keep it as a document
# Form.Create builds the same form without showing it, and Form.ToJson writes it out. A form saved this way can be reviewed, diffed and loaded again with Form.FromJson.
create = Interlude.Form.Create(title=string, elements=code_block_6)
toJson = Interlude.Form.ToJson(form=create)

# group: Read the answer
# Answers come back keyed by the field's key, whatever the form looked like.
getString = Interlude.Result.GetString(result=show.form, key=string_2)
