# Dynamo graph Interlude.Condition.IsChecked.dyn (Dynamo 4.2.0.5752)
# Interlude.Condition.IsChecked: true while a tick box is ticked.
# packages: Interlude 1.1.2

# group: Describe the field
# A condition is an ingredient: it does nothing until a Behavior node consumes it. Here IsChecked reads the tick box by key, and VisibleIf hides the suffix field until it is ticked. Both fields go into the form together, which is what makes the condition observable.
code_block = CodeBlock { "Add a suffix"; true; "addSuffix"; }
checkBox = Interlude.Input.CheckBox(label=code_block.out0, defaultValue=code_block.out1, key=code_block.out2)
code_block_2 = CodeBlock { "Suffix"; "-REV"; ""; "suffix"; }
textBox = Interlude.Input.TextBox(label=code_block_2.out0, defaultValue=code_block_2.out1, placeholder=code_block_2.out2, key=code_block_2.out3)
code_block_3 = CodeBlock { "addSuffix"; }
isChecked = Interlude.Condition.IsChecked(key=code_block_3)
visibleIf = Interlude.Behavior.VisibleIf(element=textBox, condition=isChecked)
code_block_4 = CodeBlock(child0=checkBox, child1=visibleIf) { [child0,child1]; }
code_block_5 = CodeBlock { 8.0; }
column = Interlude.Layout.Column(elements=code_block_4, spacing=code_block_5)

# group: Show it
# trigger is false so the graph runs without opening the dialog: every field comes back with its default and buttonClicked reads "skipped". Set it to true to see the form.
string = StringInput("Rename views")
code_block_6 = CodeBlock(field=column) { [field]; }
boolean = BoolSelector(false)
show = Interlude.Form.Show(title=string, elements=code_block_6, trigger=boolean)
string_2 = StringInput("suffix")

# group: Keep it as a document
# Form.Create builds the same form without showing it, and Form.ToJson writes it out. A form saved this way can be reviewed, diffed and loaded again with Form.FromJson.
create = Interlude.Form.Create(title=string, elements=code_block_6)
toJson = Interlude.Form.ToJson(form=create)

# group: Read the answer
# Answers come back keyed by the field's key, whatever the form looked like.
getString = Interlude.Result.GetString(result=show.form, key=string_2)
