# Dynamo graph Interlude.Condition.IsNotChecked.dyn (Dynamo 4.2.0.5752)
# Interlude.Condition.IsNotChecked: true while a tick box or switch is off.
# packages: Interlude 1.1.2

# group: Describe the field
# Reads a tick box the other way up, which is what an "override the defaults" section wants: the settings appear when the box is cleared rather than when it is ticked.
code_block = CodeBlock { "Use the practice defaults"; false; "useDefaults"; }
checkBox = Interlude.Input.CheckBox(label=code_block.out0, defaultValue=code_block.out1, key=code_block.out2)
code_block_2 = CodeBlock { "Output template"; "A1 landscape"; ""; "template"; }
textBox = Interlude.Input.TextBox(label=code_block_2.out0, defaultValue=code_block_2.out1, placeholder=code_block_2.out2, key=code_block_2.out3)
code_block_3 = CodeBlock { "useDefaults"; }
isNotChecked = Interlude.Condition.IsNotChecked(key=code_block_3)
visibleIf = Interlude.Behavior.VisibleIf(element=textBox, condition=isNotChecked)
code_block_4 = CodeBlock(child0=checkBox, child1=visibleIf) { [child0,child1]; }
code_block_5 = CodeBlock { 8.0; }
column = Interlude.Layout.Column(elements=code_block_4, spacing=code_block_5)

# group: Show it
# trigger is false so the graph runs without opening the dialog: every field comes back with its default and buttonClicked reads "skipped". Set it to true to see the form.
string = StringInput("Export")
code_block_6 = CodeBlock(field=column) { [field]; }
boolean = BoolSelector(false)
show = Interlude.Form.Show(title=string, elements=code_block_6, trigger=boolean)
string_2 = StringInput("template")

# group: Keep it as a document
# Form.Create builds the same form without showing it, and Form.ToJson writes it out. A form saved this way can be reviewed, diffed and loaded again with Form.FromJson.
create = Interlude.Form.Create(title=string, elements=code_block_6)
toJson = Interlude.Form.ToJson(form=create)

# group: Read the answer
# Answers come back keyed by the field's key, whatever the form looked like.
getString = Interlude.Result.GetString(result=show.form, key=string_2)
