# Dynamo graph Interlude.Condition.LessThan.dyn (Dynamo 4.2.0.5752)
# Interlude.Condition.LessThan: true while a number is below a value.
# packages: Interlude 1.1.1

# group: Describe the field
# The mirror of Condition.GreaterThan. A tight tolerance is the case worth warning about, so the extra option appears only once the number drops under a millimetre.
code_block = CodeBlock { "Tolerance"; 0.5; 0; 10; 0.1; 2; "mm"; "tolerance"; }
number = Interlude.Input.Number(label=code_block.out0, defaultValue=code_block.out1, minimum=code_block.out2, maximum=code_block.out3, increment=code_block.out4, decimalPlaces=code_block.out5, unit=code_block.out6, key=code_block.out7)
code_block_2 = CodeBlock { "Report near misses"; true; "reportNearMisses"; }
checkBox = Interlude.Input.CheckBox(label=code_block_2.out0, defaultValue=code_block_2.out1, key=code_block_2.out2)
code_block_3 = CodeBlock { "tolerance"; 1; }
lessThan = Interlude.Condition.LessThan(key=code_block_3.out0, value=code_block_3.out1)
visibleIf = Interlude.Behavior.VisibleIf(element=checkBox, condition=lessThan)
code_block_4 = CodeBlock(child0=number, child1=visibleIf) { [child0,child1]; }
code_block_5 = CodeBlock { 8.0; }
column = Interlude.Layout.Column(elements=code_block_4, spacing=code_block_5)

# group: Show it
# trigger is false so the graph runs without opening the dialog: every field comes back with its default and buttonClicked reads "skipped". Set it to true to see the form.
string = StringInput("Model audit")
code_block_6 = CodeBlock(field=column) { [field]; }
boolean = BoolSelector(false)
show = Interlude.Form.Show(title=string, elements=code_block_6, trigger=boolean)
string_2 = StringInput()

# group: Keep it as a document
# Form.Create builds the same form without showing it, and Form.ToJson writes it out. A form saved this way can be reviewed, diffed and loaded again with Form.FromJson.
create = Interlude.Form.Create(title=string, elements=code_block_6)
toJson = Interlude.Form.ToJson(form=create)

# group: Read the answer
# Answers come back keyed by the field's key, whatever the form looked like.
getString = Interlude.Result.GetString(result=show.form, key=string_2)
