# Dynamo graph Interlude.Condition.Matches.dyn (Dynamo 4.2.0.5752)
# Interlude.Condition.Matches: true while a field matches a regular expression.
# packages: Interlude 1.1.1

# group: Describe the field
# A .NET regular expression, unanchored unless the pattern says otherwise — this one anchors both ends, so it describes the whole answer rather than something found inside it. Rule.Regex is the same test used to stop a form rather than to change it.
code_block = CodeBlock { "Project code"; "AB-1234"; "Two letters, a dash, four digits"; "projectCode"; }
textBox = Interlude.Input.TextBox(label=code_block.out0, defaultValue=code_block.out1, placeholder=code_block.out2, key=code_block.out3)
code_block_2 = CodeBlock { "Register with the practice log"; true; "register"; }
checkBox = Interlude.Input.CheckBox(label=code_block_2.out0, defaultValue=code_block_2.out1, key=code_block_2.out2)
code_block_3 = CodeBlock { "projectCode"; "^[A-Z]{2}-\\d{4}$"; false; }
matches = Interlude.Condition.Matches(key=code_block_3.out0, pattern=code_block_3.out1, ignoreCase=code_block_3.out2)
visibleIf = Interlude.Behavior.VisibleIf(element=checkBox, condition=matches)
code_block_4 = CodeBlock(child0=textBox, child1=visibleIf) { [child0,child1]; }
code_block_5 = CodeBlock { 8.0; }
column = Interlude.Layout.Column(elements=code_block_4, spacing=code_block_5)

# group: Show it
# trigger is false so the graph runs without opening the dialog: every field comes back with its default and buttonClicked reads "skipped". Set it to true to see the form.
string = StringInput("Site survey")
code_block_6 = CodeBlock(field=column) { [field]; }
boolean = BoolSelector(false)
show = Interlude.Form.Show(title=string, elements=code_block_6, trigger=boolean)
string_2 = StringInput()

# group: Keep it as a document
# Form.Create builds the same form without showing it, and Form.ToJson writes it out. A form saved this way can be reviewed, diffed and loaded again with Form.FromJson.
create = Interlude.Form.Create(title=string, elements=code_block_6)
toJson = Interlude.Form.ToJson(form=create)

# group: Read the answer
# Answers come back keyed by the field's key, whatever the form looked like.
getString = Interlude.Result.GetString(result=show.form, key=string_2)
