# Dynamo graph Interlude.Condition.Or.dyn (Dynamo 4.2.0.5752)
# Interlude.Condition.Or: true while at least one of several conditions is true.
# packages: Interlude 1.1.1

# group: Describe the field
# Asking where to put the files only once there is something to put there. An empty list is false, the opposite of Condition.And, and for the same reason: neither should change the answer when nothing has been said.
code_block = CodeBlock { "Export sheets"; false; "sheets"; }
checkBox = Interlude.Input.CheckBox(label=code_block.out0, defaultValue=code_block.out1, key=code_block.out2)
code_block_2 = CodeBlock { "Export views"; true; "views"; }
checkBox_2 = Interlude.Input.CheckBox(label=code_block_2.out0, defaultValue=code_block_2.out1, key=code_block_2.out2)
code_block_3 = CodeBlock { "Output folder"; ""; "outputFolder"; }
directoryPath = Interlude.Input.DirectoryPath(label=code_block_3.out0, defaultValue=code_block_3.out1, key=code_block_3.out2)
code_block_4 = CodeBlock { "sheets"; }
isChecked = Interlude.Condition.IsChecked(key=code_block_4)
code_block_5 = CodeBlock { "views"; }
isChecked_2 = Interlude.Condition.IsChecked(key=code_block_5)
code_block_6 = CodeBlock(child0=isChecked, child1=isChecked_2) { [child0,child1]; }
or_ = Interlude.Condition.Or(conditions=code_block_6)
visibleIf = Interlude.Behavior.VisibleIf(element=directoryPath, condition=or_)
code_block_7 = CodeBlock(child0=checkBox, child1=checkBox_2, child2=visibleIf) { [child0,child1,child2]; }
code_block_8 = CodeBlock { 8.0; }
column = Interlude.Layout.Column(elements=code_block_7, spacing=code_block_8)

# group: Show it
# trigger is false so the graph runs without opening the dialog: every field comes back with its default and buttonClicked reads "skipped". Set it to true to see the form.
string = StringInput("Export")
code_block_9 = CodeBlock(field=column) { [field]; }
boolean = BoolSelector(false)
show = Interlude.Form.Show(title=string, elements=code_block_9, trigger=boolean)
string_2 = StringInput()

# group: Keep it as a document
# Form.Create builds the same form without showing it, and Form.ToJson writes it out. A form saved this way can be reviewed, diffed and loaded again with Form.FromJson.
create = Interlude.Form.Create(title=string, elements=code_block_9)
toJson = Interlude.Form.ToJson(form=create)

# group: Read the answer
# Answers come back keyed by the field's key, whatever the form looked like.
getString = Interlude.Result.GetString(result=show.form, key=string_2)
