# Dynamo graph Interlude.Condition.StartsWith.dyn (Dynamo 4.2.0.5752)
# Interlude.Condition.StartsWith: true while a field begins with the value.
# packages: Interlude 1.0.5

# group: Describe the field
# Prefixes carry meaning in most sheet numbering, so this is how a form reacts to the discipline without a separate field asking for it.
code_block = CodeBlock { "Sheet number"; "A-101"; ""; "sheetNumber"; }
textBox = Interlude.Input.TextBox(label=code_block.out0, defaultValue=code_block.out1, placeholder=code_block.out2, key=code_block.out3)
code_block_2 = CodeBlock { "Architectural revision"; "P01"; ""; "revision"; }
textBox_2 = Interlude.Input.TextBox(label=code_block_2.out0, defaultValue=code_block_2.out1, placeholder=code_block_2.out2, key=code_block_2.out3)
code_block_3 = CodeBlock { "sheetNumber"; "A-"; true; }
startsWith = Interlude.Condition.StartsWith(key=code_block_3.out0, value=code_block_3.out1, ignoreCase=code_block_3.out2)
visibleIf = Interlude.Behavior.VisibleIf(element=textBox_2, condition=startsWith)
code_block_4 = CodeBlock(child0=textBox, child1=visibleIf) { [child0,child1]; }
code_block_5 = CodeBlock { 8.0; }
column = Interlude.Layout.Column(elements=code_block_4, spacing=code_block_5)

# group: Show it
# trigger is false so the graph runs without opening the dialog: every field comes back with its default and buttonClicked reads "skipped". Set it to true to see the form.
string = StringInput("Rename views")
code_block_6 = CodeBlock(field=column) { [field]; }
boolean = BoolSelector(false)
show = Interlude.Form.Show(title=string, elements=code_block_6, trigger=boolean)
string_2 = StringInput("revision")

# group: Keep it as a document
# Form.Create builds the same form without showing it, and Form.ToJson writes it out. A form saved this way can be reviewed, diffed and loaded again with Form.FromJson.
create = Interlude.Form.Create(title=string, elements=code_block_6)
toJson = Interlude.Form.ToJson(form=create)

# group: Read the answer
# Answers come back keyed by the field's key, whatever the form looked like.
getString = Interlude.Result.GetString(result=show.form, key=string_2)
