# Dynamo graph Interlude.Form.Forget.dyn (Dynamo 4.2.0.5752)
# Interlude.Form.Forget: clears the answers remembered for a form.
# packages: Interlude 1.1.2

# group: Describe the field
# What the form holds, built left to right: literals into a code block, the code block into a node, and the nodes gathered into the list Form.Show takes.
code_block = CodeBlock { "Project name"; "Tower A"; "As it appears on the drawing"; "projectName"; }
textBox = Interlude.Input.TextBox(label=code_block.out0, defaultValue=code_block.out1, placeholder=code_block.out2, key=code_block.out3)
code_block_2 = CodeBlock { "Discipline"; ["ARC","STR","MEP"]; ["Architectural","Structural","Services"]; "STR"; "Pick one"; "discipline"; }
dropDown = Interlude.Input.DropDown(label=code_block_2.out0, items=code_block_2.out1, displayNames=code_block_2.out2, defaultValue=code_block_2.out3, placeholder=code_block_2.out4, key=code_block_2.out5)
code_block_3 = CodeBlock { "Include basement"; true; "includeBasement"; }
checkBox = Interlude.Input.CheckBox(label=code_block_3.out0, defaultValue=code_block_3.out1, key=code_block_3.out2)
code_block_4 = CodeBlock(child0=textBox, child1=dropDown, child2=checkBox) { [child0,child1,child2]; }
code_block_5 = CodeBlock { 8.0; }
column = Interlude.Layout.Column(elements=code_block_4, spacing=code_block_5)

# group: Forget the answers
# Answers are remembered per form between runs, which is what makes a form worth reopening. This is how a graph starts again from the defaults. An empty formId clears every form rather than one, which is a bigger hammer than it looks.
string = StringInput("site-survey")
forget = Interlude.Form.Forget(formId=string)

# group: Show it
# trigger is false so the graph runs without opening the dialog: every field comes back with its default and buttonClicked reads "skipped". Set it to true to see the form.
string_2 = StringInput("Site survey")
code_block_6 = CodeBlock(field=column) { [field]; }
boolean = BoolSelector(false)
show = Interlude.Form.Show(title=string_2, elements=code_block_6, trigger=boolean, formId=string)
string_3 = StringInput("projectName")

# group: Keep it as a document
# Form.Create builds the same form without showing it, and Form.ToJson writes it out. A form saved this way can be reviewed, diffed and loaded again with Form.FromJson.
create = Interlude.Form.Create(title=string_2, elements=code_block_6, formId=string)
toJson = Interlude.Form.ToJson(form=create)

# group: Read the answer
# Answers come back keyed by the field's key, whatever the form looked like.
getString = Interlude.Result.GetString(result=show.form, key=string_3)
