# Dynamo graph Interlude.Form.WithOptions.dyn (Dynamo 4.2.0.5752)
# Interlude.Form.WithOptions: replaces the options of one choice field in a form that already exists.
# packages: Interlude 1.0.4

# group: Describe the field
# What the form holds, built left to right: literals into a code block, the code block into a node, and the nodes gathered into the list Form.Show takes.
code_block = CodeBlock { "Project name"; "Tower A"; "As it appears on the drawing"; "projectName"; }
textBox = Interlude.Input.TextBox(label=code_block.out0, defaultValue=code_block.out1, placeholder=code_block.out2, key=code_block.out3)
code_block_2 = CodeBlock { "Discipline"; ["ARC","STR","MEP"]; ["Architectural","Structural","Services"]; "STR"; "Pick one"; "discipline"; }
dropDown = Interlude.Input.DropDown(label=code_block_2.out0, items=code_block_2.out1, displayNames=code_block_2.out2, defaultValue=code_block_2.out3, placeholder=code_block_2.out4, key=code_block_2.out5)
code_block_3 = CodeBlock { "Include basement"; true; "includeBasement"; }
checkBox = Interlude.Input.CheckBox(label=code_block_3.out0, defaultValue=code_block_3.out1, key=code_block_3.out2)
code_block_4 = CodeBlock(child0=textBox, child1=dropDown, child2=checkBox) { [child0,child1,child2]; }
code_block_5 = CodeBlock { 8.0; }
column = Interlude.Layout.Column(elements=code_block_4, spacing=code_block_5)

# group: Show it
# trigger is false so the graph runs without opening the dialog: every field comes back with its default and buttonClicked reads "skipped". Set it to true to see the form.
string = StringInput("Site survey")
code_block_6 = CodeBlock(field=column) { [field]; }
boolean = BoolSelector(false)
show = Interlude.Form.Show(title=string, elements=code_block_6, trigger=boolean)
string_2 = StringInput("projectName")

# group: Read the answer
# Answers come back keyed by the field's key, whatever the form looked like.
getString = Interlude.Result.GetString(result=show.form, key=string_2)

# group: Keep it as a document
# Form.Create builds the same form without showing it, and Form.ToJson writes it out. A form saved this way can be reviewed, diffed and loaded again with Form.FromJson.
create = Interlude.Form.Create(title=string, elements=code_block_6)
toJson = Interlude.Form.ToJson(form=create)

# group: Load it back
# What makes a checked-in form usable with live model data. The file cannot carry Revit elements — they do not exist in another model — so it holds the layout, the labels, the conditions and the validation, and the graph fills in the one field whose contents only the model knows.
fromJson = Interlude.Form.FromJson(json=toJson)
code_block_7 = CodeBlock { "discipline"; ["ARC","STR","MEP","CIV"]; }
withOptions = Interlude.Form.WithOptions(form=fromJson, key=code_block_7.out0, items=code_block_7.out1)
check = Interlude.Form.Check(form=withOptions)
showDefinition = Interlude.Form.ShowDefinition(form=withOptions, trigger=boolean)
