# Dynamo graph Interlude.Input.CheckBox.dyn (Dynamo 4.2.0.5752)
# Interlude.Input.CheckBox: a tick box, read back as a boolean.
# packages: Interlude 1.1.1

# group: Describe the field
# A tick box. Use it for a setting that is on or off; Input.Toggle is the same answer with a switch instead, and captions for each state.
code_block = CodeBlock { "Include basement"; true; "includeBasement"; }
checkBox = Interlude.Input.CheckBox(label=code_block.out0, defaultValue=code_block.out1, key=code_block.out2)

# group: Show it
# trigger is false so the graph runs without opening the dialog: every field comes back with its default and buttonClicked reads "skipped". Set it to true to see the form.
string = StringInput("Site survey")
code_block_2 = CodeBlock(field=checkBox) { [field]; }
boolean = BoolSelector(false)
show = Interlude.Form.Show(title=string, elements=code_block_2, trigger=boolean)
string_2 = StringInput("includeBasement")

# group: Keep it as a document
# Form.Create builds the same form without showing it, and Form.ToJson writes it out. A form saved this way can be reviewed, diffed and loaded again with Form.FromJson.
create = Interlude.Form.Create(title=string, elements=code_block_2)
toJson = Interlude.Form.ToJson(form=create)

# group: Read the answer
# Answers come back keyed by the field's key, whatever the form looked like.
getBool = Interlude.Result.GetBool(result=show.form, key=string_2)
