# Dynamo graph Interlude.Input.ColorPicker.dyn (Dynamo 4.2.0.5752)
# Interlude.Input.ColorPicker: a colour, read back as a Dynamo colour.
# packages: Interlude 1.0.4

# group: Describe the field
# A colour, written as a hex string. presets put the practice palette one click away. Result.GetColor hands back a Dynamo colour rather than the string.
code_block = CodeBlock { "Zone colour"; "#E8734A"; false; ["#E8734A","#4A90D9","#7CB342"]; "zoneColour"; }
colorPicker = Interlude.Input.ColorPicker(label=code_block.out0, defaultValue=code_block.out1, showAlpha=code_block.out2, presets=code_block.out3, key=code_block.out4)

# group: Show it
# trigger is false so the graph runs without opening the dialog: every field comes back with its default and buttonClicked reads "skipped". Set it to true to see the form.
string = StringInput("Zoning")
code_block_2 = CodeBlock(field=colorPicker) { [field]; }
boolean = BoolSelector(false)
show = Interlude.Form.Show(title=string, elements=code_block_2, trigger=boolean)
string_2 = StringInput("zoneColour")

# group: Keep it as a document
# Form.Create builds the same form without showing it, and Form.ToJson writes it out. A form saved this way can be reviewed, diffed and loaded again with Form.FromJson.
create = Interlude.Form.Create(title=string, elements=code_block_2)
toJson = Interlude.Form.ToJson(form=create)

# group: Read the answer
# Answers come back keyed by the field's key, whatever the form looked like.
getColor = Interlude.Result.GetColor(result=show.form, key=string_2)
