# Dynamo graph Interlude.Input.DatePicker.dyn (Dynamo 4.2.0.5752)
# Interlude.Input.DatePicker: a date, optionally with a time.
# packages: Interlude 1.0.5

# group: Describe the field
# A date from a calendar. defaultValue left null starts at today; minimum and maximum bound what can be picked. Read it back with Result.GetDate.
code_block = CodeBlock { "Survey date"; null; false; null; null; "surveyDate"; }
datePicker = Interlude.Input.DatePicker(label=code_block.out0, defaultValue=code_block.out1, includeTime=code_block.out2, minimum=code_block.out3, maximum=code_block.out4, key=code_block.out5)

# group: Show it
# trigger is false so the graph runs without opening the dialog: every field comes back with its default and buttonClicked reads "skipped". Set it to true to see the form.
string = StringInput("Site survey")
code_block_2 = CodeBlock(field=datePicker) { [field]; }
boolean = BoolSelector(false)
show = Interlude.Form.Show(title=string, elements=code_block_2, trigger=boolean)
string_2 = StringInput("surveyDate")

# group: Keep it as a document
# Form.Create builds the same form without showing it, and Form.ToJson writes it out. A form saved this way can be reviewed, diffed and loaded again with Form.FromJson.
create = Interlude.Form.Create(title=string, elements=code_block_2)
toJson = Interlude.Form.ToJson(form=create)

# group: Read the answer
# Answers come back keyed by the field's key, whatever the form looked like.
getDate = Interlude.Result.GetDate(result=show.form, key=string_2)
