# Dynamo graph Interlude.Input.DirectoryPath.dyn (Dynamo 4.2.0.5752)
# Interlude.Input.DirectoryPath: a folder chosen from a browse dialog.
# packages: Interlude 1.0.5

# group: Describe the field
# A folder rather than a file. Pair it with Rule.FolderExists when the graph is about to write into whatever comes back.
code_block = CodeBlock { "Output folder"; ""; "outputFolder"; }
directoryPath = Interlude.Input.DirectoryPath(label=code_block.out0, defaultValue=code_block.out1, key=code_block.out2)

# group: Show it
# trigger is false so the graph runs without opening the dialog: every field comes back with its default and buttonClicked reads "skipped". Set it to true to see the form.
string = StringInput("Export")
code_block_2 = CodeBlock(field=directoryPath) { [field]; }
boolean = BoolSelector(false)
show = Interlude.Form.Show(title=string, elements=code_block_2, trigger=boolean)
string_2 = StringInput("outputFolder")

# group: Keep it as a document
# Form.Create builds the same form without showing it, and Form.ToJson writes it out. A form saved this way can be reviewed, diffed and loaded again with Form.FromJson.
create = Interlude.Form.Create(title=string, elements=code_block_2)
toJson = Interlude.Form.ToJson(form=create)

# group: Read the answer
# Answers come back keyed by the field's key, whatever the form looked like.
getString = Interlude.Result.GetString(result=show.form, key=string_2)
