# Dynamo graph Interlude.Input.DropDown.dyn (Dynamo 4.2.0.5752)
# Interlude.Input.DropDown: one choice from a list.
# packages: Interlude 1.1.1

# group: Describe the field
# One choice from a list. items are the values that come back; displayNames are only what the user reads, so the answer here is "STR" rather than "Structural".
code_block = CodeBlock { "Discipline"; ["ARC","STR","MEP"]; ["Architectural","Structural","Services"]; "STR"; "Pick one"; "discipline"; }
dropDown = Interlude.Input.DropDown(label=code_block.out0, items=code_block.out1, displayNames=code_block.out2, defaultValue=code_block.out3, placeholder=code_block.out4, key=code_block.out5)

# group: Show it
# trigger is false so the graph runs without opening the dialog: every field comes back with its default and buttonClicked reads "skipped". Set it to true to see the form.
string = StringInput("Site survey")
code_block_2 = CodeBlock(field=dropDown) { [field]; }
boolean = BoolSelector(false)
show = Interlude.Form.Show(title=string, elements=code_block_2, trigger=boolean)
string_2 = StringInput("discipline")

# group: Keep it as a document
# Form.Create builds the same form without showing it, and Form.ToJson writes it out. A form saved this way can be reviewed, diffed and loaded again with Form.FromJson.
create = Interlude.Form.Create(title=string, elements=code_block_2)
toJson = Interlude.Form.ToJson(form=create)

# group: Read the answer
# Answers come back keyed by the field's key, whatever the form looked like.
getString = Interlude.Result.GetString(result=show.form, key=string_2)
