# Dynamo graph Interlude.Input.FilePath.dyn (Dynamo 4.2.0.5752)
# Interlude.Input.FilePath: a file chosen from a browse dialog.
# packages: Interlude 1.1.2

# group: Describe the field
# A file to open or, with forSaving, a name to write. filter is a standard Windows filter string. With allowMultiple the answer is a list, read with Result.GetFilePaths.
code_block = CodeBlock { "Template file"; ""; "Revit template (*.rte)|*.rte"; false; false; "templateFile"; }
filePath = Interlude.Input.FilePath(label=code_block.out0, defaultValue=code_block.out1, filter=code_block.out2, allowMultiple=code_block.out3, forSaving=code_block.out4, key=code_block.out5)

# group: Show it
# trigger is false so the graph runs without opening the dialog: every field comes back with its default and buttonClicked reads "skipped". Set it to true to see the form.
string = StringInput("Export")
code_block_2 = CodeBlock(field=filePath) { [field]; }
boolean = BoolSelector(false)
show = Interlude.Form.Show(title=string, elements=code_block_2, trigger=boolean)
string_2 = StringInput("templateFile")

# group: Keep it as a document
# Form.Create builds the same form without showing it, and Form.ToJson writes it out. A form saved this way can be reviewed, diffed and loaded again with Form.FromJson.
create = Interlude.Form.Create(title=string, elements=code_block_2)
toJson = Interlude.Form.ToJson(form=create)

# group: Read the answer
# Answers come back keyed by the field's key, whatever the form looked like.
getString = Interlude.Result.GetString(result=show.form, key=string_2)
