# Dynamo graph Interlude.Input.Integer.dyn (Dynamo 4.2.0.5752)
# Interlude.Input.Integer: a whole-number field with bounds, read back as an integer.
# packages: Interlude 1.1.2

# group: Describe the field
# A whole number. The same shape as Input.Number without the decimal places, so the answer is an integer rather than a double that happens to be round.
code_block = CodeBlock { "Storeys"; 12; 1; 60; 1; ""; "storeys"; }
integer = Interlude.Input.Integer(label=code_block.out0, defaultValue=code_block.out1, minimum=code_block.out2, maximum=code_block.out3, increment=code_block.out4, unit=code_block.out5, key=code_block.out6)

# group: Show it
# trigger is false so the graph runs without opening the dialog: every field comes back with its default and buttonClicked reads "skipped". Set it to true to see the form.
string = StringInput("Site survey")
code_block_2 = CodeBlock(field=integer) { [field]; }
boolean = BoolSelector(false)
show = Interlude.Form.Show(title=string, elements=code_block_2, trigger=boolean)
string_2 = StringInput("storeys")

# group: Keep it as a document
# Form.Create builds the same form without showing it, and Form.ToJson writes it out. A form saved this way can be reviewed, diffed and loaded again with Form.FromJson.
create = Interlude.Form.Create(title=string, elements=code_block_2)
toJson = Interlude.Form.ToJson(form=create)

# group: Read the answer
# Answers come back keyed by the field's key, whatever the form looked like.
getInteger = Interlude.Result.GetInteger(result=show.form, key=string_2)
