# Dynamo graph Interlude.Input.ListBox.dyn (Dynamo 4.2.0.5752)
# Interlude.Input.ListBox: several choices from a list.
# packages: Interlude 1.1.1

# group: Describe the field
# Several choices at once. With allowMultiple the answer is a list, so read it with Result.GetList rather than Result.GetString.
code_block = CodeBlock()
# ---------- code_block.designscript (7 lines) ----------
"Levels to export";
["L00","L01","L02","RF"];
["Level 00","Level 01","Level 02","Roof"];
true;
["L01","L02"];
4;
"levels";
# ----------------------------------------
listBox = Interlude.Input.ListBox(label=code_block.out0, items=code_block.out1, displayNames=code_block.out2, allowMultiple=code_block.out3, defaultValue=code_block.out4, visibleRows=code_block.out5, key=code_block.out6)

# group: Show it
# trigger is false so the graph runs without opening the dialog: every field comes back with its default and buttonClicked reads "skipped". Set it to true to see the form.
string = StringInput("Export")
code_block_2 = CodeBlock(field=listBox) { [field]; }
boolean = BoolSelector(false)
show = Interlude.Form.Show(title=string, elements=code_block_2, trigger=boolean)
string_2 = StringInput("levels")

# group: Keep it as a document
# Form.Create builds the same form without showing it, and Form.ToJson writes it out. A form saved this way can be reviewed, diffed and loaded again with Form.FromJson.
create = Interlude.Form.Create(title=string, elements=code_block_2)
toJson = Interlude.Form.ToJson(form=create)

# group: Read the answer
# Answers come back keyed by the field's key, whatever the form looked like.
getList = Interlude.Result.GetList(result=show.form, key=string_2)
