# Dynamo graph Interlude.Input.Number.dyn (Dynamo 4.2.0.5752)
# Interlude.Input.Number: a decimal field with bounds and a unit, read back as a number.
# packages: Interlude 1.0.5

# group: Describe the field
# A decimal number. minimum and maximum bound it, increment is the step the spinner takes, and unit is drawn inside the field rather than added to the answer.
code_block = CodeBlock { "Floor to floor"; 3.6; 2.4; 6; 0.1; 2; "m"; "floorToFloor"; }
number = Interlude.Input.Number(label=code_block.out0, defaultValue=code_block.out1, minimum=code_block.out2, maximum=code_block.out3, increment=code_block.out4, decimalPlaces=code_block.out5, unit=code_block.out6, key=code_block.out7)

# group: Show it
# trigger is false so the graph runs without opening the dialog: every field comes back with its default and buttonClicked reads "skipped". Set it to true to see the form.
string = StringInput("Site survey")
code_block_2 = CodeBlock(field=number) { [field]; }
boolean = BoolSelector(false)
show = Interlude.Form.Show(title=string, elements=code_block_2, trigger=boolean)
string_2 = StringInput("floorToFloor")

# group: Keep it as a document
# Form.Create builds the same form without showing it, and Form.ToJson writes it out. A form saved this way can be reviewed, diffed and loaded again with Form.FromJson.
create = Interlude.Form.Create(title=string, elements=code_block_2)
toJson = Interlude.Form.ToJson(form=create)

# group: Read the answer
# Answers come back keyed by the field's key, whatever the form looked like.
getNumber = Interlude.Result.GetNumber(result=show.form, key=string_2)
