# Dynamo graph Interlude.Input.Password.dyn (Dynamo 4.2.0.5752)
# Interlude.Input.Password: a masked field, shown in a form and read back by key.
# packages: Interlude 1.0.4

# group: Describe the field
# Text that is masked as it is typed. There is no default value port on purpose: a password written into a graph is a password in version control.
code_block = CodeBlock { "API key"; "Paste the key from the portal"; "apiKey"; }
password = Interlude.Input.Password(label=code_block.out0, placeholder=code_block.out1, key=code_block.out2)

# group: Show it
# trigger is false so the graph runs without opening the dialog: every field comes back with its default and buttonClicked reads "skipped". Set it to true to see the form.
string = StringInput("Publish settings")
code_block_2 = CodeBlock(field=password) { [field]; }
boolean = BoolSelector(false)
show = Interlude.Form.Show(title=string, elements=code_block_2, trigger=boolean)
string_2 = StringInput("apiKey")

# group: Keep it as a document
# Form.Create builds the same form without showing it, and Form.ToJson writes it out. A form saved this way can be reviewed, diffed and loaded again with Form.FromJson.
create = Interlude.Form.Create(title=string, elements=code_block_2)
toJson = Interlude.Form.ToJson(form=create)

# group: Read the answer
# Answers come back keyed by the field's key, whatever the form looked like.
getString = Interlude.Result.GetString(result=show.form, key=string_2)
