# Dynamo graph Interlude.Input.RadioButtons.dyn (Dynamo 4.2.0.5752)
# Interlude.Input.RadioButtons: one choice, with every option visible.
# packages: Interlude 1.0.5

# group: Describe the field
# The same answer as a drop-down, with every option on screen. Worth it up to about five choices, past which a drop-down reads better.
code_block = CodeBlock { "Units"; ["mm","m","ft"]; ["Millimetres","Metres","Feet and inches"]; "m"; false; "units"; }
radioButtons = Interlude.Input.RadioButtons(label=code_block.out0, items=code_block.out1, displayNames=code_block.out2, defaultValue=code_block.out3, horizontal=code_block.out4, key=code_block.out5)

# group: Show it
# trigger is false so the graph runs without opening the dialog: every field comes back with its default and buttonClicked reads "skipped". Set it to true to see the form.
string = StringInput("Export")
code_block_2 = CodeBlock(field=radioButtons) { [field]; }
boolean = BoolSelector(false)
show = Interlude.Form.Show(title=string, elements=code_block_2, trigger=boolean)
string_2 = StringInput("units")

# group: Keep it as a document
# Form.Create builds the same form without showing it, and Form.ToJson writes it out. A form saved this way can be reviewed, diffed and loaded again with Form.FromJson.
create = Interlude.Form.Create(title=string, elements=code_block_2)
toJson = Interlude.Form.ToJson(form=create)

# group: Read the answer
# Answers come back keyed by the field's key, whatever the form looked like.
getString = Interlude.Result.GetString(result=show.form, key=string_2)
