# Dynamo graph Interlude.Input.SelectElements.dyn (Dynamo 4.2.0.5752)
# Interlude.Input.SelectElements: elements picked directly in the Revit model.
# packages: Interlude 1.1.1

# group: Describe the field
# The form minimises while the user picks in the model and comes back when they finish. The answer is the picked Revit elements themselves — usable by any Revit node downstream — read with Result.GetList. Picking needs Dynamo inside Revit; anywhere else the button is disabled and the rest of the form still works.
code_block = CodeBlock { "Rooms"; true; "Select rooms…"; "Pick the rooms to renumber, then press Finish."; null; "rooms"; }
selectElements = Interlude.Input.SelectElements(label=code_block.out0, allowMultiple=code_block.out1, buttonText=code_block.out2, prompt=code_block.out3, defaultValue=code_block.out4, key=code_block.out5)

# group: Show it
# trigger is false so the graph runs without opening the dialog: every field comes back with its default and buttonClicked reads "skipped". Set it to true to see the form.
string = StringInput("Renumber rooms")
code_block_2 = CodeBlock(field=selectElements) { [field]; }
boolean = BoolSelector(false)
show = Interlude.Form.Show(title=string, elements=code_block_2, trigger=boolean)
string_2 = StringInput("rooms")

# group: Keep it as a document
# Form.Create builds the same form without showing it, and Form.ToJson writes it out. A form saved this way can be reviewed, diffed and loaded again with Form.FromJson.
create = Interlude.Form.Create(title=string, elements=code_block_2)
toJson = Interlude.Form.ToJson(form=create)

# group: Read the answer
# Answers come back keyed by the field's key, whatever the form looked like.
getList = Interlude.Result.GetList(result=show.form, key=string_2)
