# Dynamo graph Interlude.Input.Slider.dyn (Dynamo 4.2.0.5752)
# Interlude.Input.Slider: a bounded number dragged rather than typed.
# packages: Interlude 1.0.5

# group: Describe the field
# A number chosen by dragging. Note the port order: minimum and maximum come before defaultValue, because a slider cannot exist without its range.
code_block = CodeBlock { "Glazing ratio"; 0.0; 1.0; 0.4; 0.05; 2; "glazingRatio"; }
slider = Interlude.Input.Slider(label=code_block.out0, minimum=code_block.out1, maximum=code_block.out2, defaultValue=code_block.out3, step=code_block.out4, decimalPlaces=code_block.out5, key=code_block.out6)

# group: Show it
# trigger is false so the graph runs without opening the dialog: every field comes back with its default and buttonClicked reads "skipped". Set it to true to see the form.
string = StringInput("Facade study")
code_block_2 = CodeBlock(field=slider) { [field]; }
boolean = BoolSelector(false)
show = Interlude.Form.Show(title=string, elements=code_block_2, trigger=boolean)
string_2 = StringInput("glazingRatio")

# group: Keep it as a document
# Form.Create builds the same form without showing it, and Form.ToJson writes it out. A form saved this way can be reviewed, diffed and loaded again with Form.FromJson.
create = Interlude.Form.Create(title=string, elements=code_block_2)
toJson = Interlude.Form.ToJson(form=create)

# group: Read the answer
# Answers come back keyed by the field's key, whatever the form looked like.
getNumber = Interlude.Result.GetNumber(result=show.form, key=string_2)
