# Dynamo graph Interlude.Input.TextArea.dyn (Dynamo 4.2.0.5752)
# Interlude.Input.TextArea: a multi-line note field, shown in a form and read back by key.
# packages: Interlude 1.1.1

# group: Describe the field
# Several lines of text. lines sets how tall the box is; the answer is still one string, with the line breaks inside it.
code_block = CodeBlock { "Scope notes"; "Trees, kerbs and spot levels."; 5; "What the survey covers"; "scopeNotes"; }
textArea = Interlude.Input.TextArea(label=code_block.out0, defaultValue=code_block.out1, lines=code_block.out2, placeholder=code_block.out3, key=code_block.out4)

# group: Show it
# trigger is false so the graph runs without opening the dialog: every field comes back with its default and buttonClicked reads "skipped". Set it to true to see the form.
string = StringInput("Site survey")
code_block_2 = CodeBlock(field=textArea) { [field]; }
boolean = BoolSelector(false)
show = Interlude.Form.Show(title=string, elements=code_block_2, trigger=boolean)
string_2 = StringInput("scopeNotes")

# group: Keep it as a document
# Form.Create builds the same form without showing it, and Form.ToJson writes it out. A form saved this way can be reviewed, diffed and loaded again with Form.FromJson.
create = Interlude.Form.Create(title=string, elements=code_block_2)
toJson = Interlude.Form.ToJson(form=create)

# group: Read the answer
# Answers come back keyed by the field's key, whatever the form looked like.
getString = Interlude.Result.GetString(result=show.form, key=string_2)
