# Dynamo graph Interlude.Input.Toggle.dyn (Dynamo 4.2.0.5752)
# Interlude.Input.Toggle: a switch with a caption for each state.
# packages: Interlude 1.1.1

# group: Describe the field
# A switch. onText and offText name the two states, which is worth doing whenever "on" and "off" are less clear than the words the job actually uses.
code_block = CodeBlock { "Publish when done"; false; "Publish"; "Hold"; "publish"; }
toggle = Interlude.Input.Toggle(label=code_block.out0, defaultValue=code_block.out1, onText=code_block.out2, offText=code_block.out3, key=code_block.out4)

# group: Show it
# trigger is false so the graph runs without opening the dialog: every field comes back with its default and buttonClicked reads "skipped". Set it to true to see the form.
string = StringInput("Publish settings")
code_block_2 = CodeBlock(field=toggle) { [field]; }
boolean = BoolSelector(false)
show = Interlude.Form.Show(title=string, elements=code_block_2, trigger=boolean)
string_2 = StringInput("publish")

# group: Keep it as a document
# Form.Create builds the same form without showing it, and Form.ToJson writes it out. A form saved this way can be reviewed, diffed and loaded again with Form.FromJson.
create = Interlude.Form.Create(title=string, elements=code_block_2)
toJson = Interlude.Form.ToJson(form=create)

# group: Read the answer
# Answers come back keyed by the field's key, whatever the form looked like.
getBool = Interlude.Result.GetBool(result=show.form, key=string_2)
