# Dynamo graph Interlude.Input.TreeItem.dyn (Dynamo 4.2.0.5752)
# Interlude.Input.TreeItem: one node of a tree, which may hold others.
# packages: Interlude 1.0.5

# group: Describe the field
# The thing Input.TreeSelect is made of, and never useful on its own — hence the TreeSelect at the root of this graph. An item holding children is a branch, and a branch with selectable false only groups them, which is what "Walls" does here.
code_block = CodeBlock { "Model categories"; true; null; true; "categories"; }
code_block_2 = CodeBlock { "Walls"; "walls"; true; false; }
code_block_3 = CodeBlock { "Basic Wall"; "basicWall"; null; false; true; }
treeItem = Interlude.Input.TreeItem(displayName=code_block_3.out0, value=code_block_3.out1, children=code_block_3.out2, expanded=code_block_3.out3, selectable=code_block_3.out4)
code_block_4 = CodeBlock(child0=treeItem) { [child0]; }
treeItem_2 = Interlude.Input.TreeItem(displayName=code_block_2.out0, value=code_block_2.out1, children=code_block_4, expanded=code_block_2.out2, selectable=code_block_2.out3)
code_block_5 = CodeBlock { "Doors"; "doors"; null; false; true; }
treeItem_3 = Interlude.Input.TreeItem(displayName=code_block_5.out0, value=code_block_5.out1, children=code_block_5.out2, expanded=code_block_5.out3, selectable=code_block_5.out4)
code_block_6 = CodeBlock(child0=treeItem_2, child1=treeItem_3) { [child0,child1]; }
treeSelect = Interlude.Input.TreeSelect(label=code_block.out0, nodes=code_block_6, allowMultiple=code_block.out1, defaultValue=code_block.out2, expandAll=code_block.out3, key=code_block.out4)

# group: Show it
# trigger is false so the graph runs without opening the dialog: every field comes back with its default and buttonClicked reads "skipped". Set it to true to see the form.
string = StringInput("Model audit")
code_block_7 = CodeBlock(field=treeSelect) { [field]; }
boolean = BoolSelector(false)
show = Interlude.Form.Show(title=string, elements=code_block_7, trigger=boolean)
string_2 = StringInput("categories")

# group: Keep it as a document
# Form.Create builds the same form without showing it, and Form.ToJson writes it out. A form saved this way can be reviewed, diffed and loaded again with Form.FromJson.
create = Interlude.Form.Create(title=string, elements=code_block_7)
toJson = Interlude.Form.ToJson(form=create)

# group: Read the answer
# Answers come back keyed by the field's key, whatever the form looked like.
getList = Interlude.Result.GetList(result=show.form, key=string_2)
