# Dynamo graph Interlude.Layout.Button.dyn (Dynamo 4.2.0.5752)
# Interlude.Layout.Button: an extra button that closes the form with a tag.
# packages: Interlude 1.0.5

# group: Describe the field
# A button beside Submit and Cancel. tag is what Result.ButtonClicked reports, so the graph can tell which one ended the form.
code_block = CodeBlock { "Export and open"; "exportOpen"; true; }
button = Interlude.Layout.Button(text=code_block.out0, tag=code_block.out1, primary=code_block.out2)

# group: Show it
# trigger is false so the graph runs without opening the dialog: every field comes back with its default and buttonClicked reads "skipped". Set it to true to see the form.
string = StringInput("Export")
code_block_2 = CodeBlock(field=button) { [field]; }
boolean = BoolSelector(false)
show = Interlude.Form.Show(title=string, elements=code_block_2, trigger=boolean)

# group: Keep it as a document
# Form.Create builds the same form without showing it, and Form.ToJson writes it out. A form saved this way can be reviewed, diffed and loaded again with Form.FromJson.
create = Interlude.Form.Create(title=string, elements=code_block_2)
toJson = Interlude.Form.ToJson(form=create)
