# Dynamo graph Interlude.Layout.Card.dyn (Dynamo 4.2.0.5752)
# Interlude.Layout.Card: a raised panel for something that deserves emphasis.
# packages: Interlude 1.0.5

# group: Describe the field
# Lifts one part of a form out of it. Used once it draws the eye; used for every group it stops meaning anything.
code_block = CodeBlock { "142 views will be renamed."; 0; false; }
label = Interlude.Layout.Label(text=code_block.out0, headingLevel=code_block.out1, muted=code_block.out2)
code_block_2 = CodeBlock(child0=label) { [child0]; }
code_block_3 = CodeBlock { "Before you start"; "This cannot be undone"; true; }
card = Interlude.Layout.Card(elements=code_block_2, header=code_block_3.out0, subheader=code_block_3.out1, shadow=code_block_3.out2)

# group: Show it
# trigger is false so the graph runs without opening the dialog: every field comes back with its default and buttonClicked reads "skipped". Set it to true to see the form.
string = StringInput("Rename views")
code_block_4 = CodeBlock(field=card) { [field]; }
boolean = BoolSelector(false)
show = Interlude.Form.Show(title=string, elements=code_block_4, trigger=boolean)

# group: Keep it as a document
# Form.Create builds the same form without showing it, and Form.ToJson writes it out. A form saved this way can be reviewed, diffed and loaded again with Form.FromJson.
create = Interlude.Form.Create(title=string, elements=code_block_4)
toJson = Interlude.Form.ToJson(form=create)
