# Dynamo graph Interlude.Layout.Cell.dyn (Dynamo 4.2.0.5752)
# Interlude.Layout.Cell: places an element at a row and column of a Grid, optionally spanning.
# packages: Interlude 1.0.5

# group: Describe the field
# Places an element in a Layout.Grid and says how many rows and columns it covers. Outside a grid the position is ignored.
code_block = CodeBlock { "Notes"; ""; ""; "notes"; }
textBox = Interlude.Input.TextBox(label=code_block.out0, defaultValue=code_block.out1, placeholder=code_block.out2, key=code_block.out3)
code_block_2 = CodeBlock { 0; 0; 1; 2; }
cell = Interlude.Layout.Cell(element=textBox, row=code_block_2.out0, column=code_block_2.out1, rowSpan=code_block_2.out2, columnSpan=code_block_2.out3)

# group: Show it
# trigger is false so the graph runs without opening the dialog: every field comes back with its default and buttonClicked reads "skipped". Set it to true to see the form.
string = StringInput("Schedule")
code_block_3 = CodeBlock(field=cell) { [field]; }
boolean = BoolSelector(false)
show = Interlude.Form.Show(title=string, elements=code_block_3, trigger=boolean)
string_2 = StringInput("notes")

# group: Keep it as a document
# Form.Create builds the same form without showing it, and Form.ToJson writes it out. A form saved this way can be reviewed, diffed and loaded again with Form.FromJson.
create = Interlude.Form.Create(title=string, elements=code_block_3)
toJson = Interlude.Form.ToJson(form=create)

# group: Read the answer
# Answers come back keyed by the field's key, whatever the form looked like.
getString = Interlude.Result.GetString(result=show.form, key=string_2)
