# Dynamo graph Interlude.Layout.Column.dyn (Dynamo 4.2.0.5752)
# Interlude.Layout.Column: elements stacked, with a spacing you choose.
# packages: Interlude 1.0.5

# group: Describe the field
# Stacks elements. A form is already a column, so this earns its place when a group needs different spacing from the rest.
code_block = CodeBlock { "Checks"; 2; false; }
label = Interlude.Layout.Label(text=code_block.out0, headingLevel=code_block.out1, muted=code_block.out2)
code_block_2 = CodeBlock { "Warnings cleared"; false; "warnings"; }
checkBox = Interlude.Input.CheckBox(label=code_block_2.out0, defaultValue=code_block_2.out1, key=code_block_2.out2)
code_block_3 = CodeBlock(child0=label, child1=checkBox) { [child0,child1]; }
code_block_4 = CodeBlock { 12.0; }
column = Interlude.Layout.Column(elements=code_block_3, spacing=code_block_4)

# group: Show it
# trigger is false so the graph runs without opening the dialog: every field comes back with its default and buttonClicked reads "skipped". Set it to true to see the form.
string = StringInput("Model audit")
code_block_5 = CodeBlock(field=column) { [field]; }
boolean = BoolSelector(false)
show = Interlude.Form.Show(title=string, elements=code_block_5, trigger=boolean)
string_2 = StringInput("warnings")

# group: Keep it as a document
# Form.Create builds the same form without showing it, and Form.ToJson writes it out. A form saved this way can be reviewed, diffed and loaded again with Form.FromJson.
create = Interlude.Form.Create(title=string, elements=code_block_5)
toJson = Interlude.Form.ToJson(form=create)

# group: Read the answer
# Answers come back keyed by the field's key, whatever the form looked like.
getBool = Interlude.Result.GetBool(result=show.form, key=string_2)
