# Dynamo graph Interlude.Layout.Dock.dyn (Dynamo 4.2.0.5752)
# Interlude.Layout.Dock: elements pinned to the edges, the last one filling what is left.
# packages: Interlude 1.0.4

# group: Describe the field
# Pins elements to edges. Each child says which side it wants with Layout.Docked; the last one takes whatever space is left.
code_block = CodeBlock { "Legend"; 0; true; }
label = Interlude.Layout.Label(text=code_block.out0, headingLevel=code_block.out1, muted=code_block.out2)
code_block_2 = CodeBlock { "The plan fills the space that is left."; }
markdown = Interlude.Layout.Markdown(text=code_block_2)
code_block_3 = CodeBlock(child0=label, child1=markdown) { [child0,child1]; }
code_block_4 = CodeBlock { true; }
dock = Interlude.Layout.Dock(elements=code_block_3, lastChildFills=code_block_4)

# group: Show it
# trigger is false so the graph runs without opening the dialog: every field comes back with its default and buttonClicked reads "skipped". Set it to true to see the form.
string = StringInput("Site survey")
code_block_5 = CodeBlock(field=dock) { [field]; }
boolean = BoolSelector(false)
show = Interlude.Form.Show(title=string, elements=code_block_5, trigger=boolean)

# group: Keep it as a document
# Form.Create builds the same form without showing it, and Form.ToJson writes it out. A form saved this way can be reviewed, diffed and loaded again with Form.FromJson.
create = Interlude.Form.Create(title=string, elements=code_block_5)
toJson = Interlude.Form.ToJson(form=create)
