# Dynamo graph Interlude.Layout.Expander.dyn (Dynamo 4.2.0.5752)
# Interlude.Layout.Expander: a group that starts collapsed.
# packages: Interlude 1.0.4

# group: Describe the field
# Hides detail behind a heading. Start it collapsed and the form opens at the size of the common case.
code_block = CodeBlock { "Advanced"; false; }
code_block_2 = CodeBlock { "Overwrite existing"; false; "overwrite"; }
checkBox = Interlude.Input.CheckBox(label=code_block_2.out0, defaultValue=code_block_2.out1, key=code_block_2.out2)
code_block_3 = CodeBlock(child0=checkBox) { [child0]; }
expander = Interlude.Layout.Expander(header=code_block.out0, elements=code_block_3, expanded=code_block.out1)

# group: Show it
# trigger is false so the graph runs without opening the dialog: every field comes back with its default and buttonClicked reads "skipped". Set it to true to see the form.
string = StringInput("Export")
code_block_4 = CodeBlock(field=expander) { [field]; }
boolean = BoolSelector(false)
show = Interlude.Form.Show(title=string, elements=code_block_4, trigger=boolean)
string_2 = StringInput("overwrite")

# group: Keep it as a document
# Form.Create builds the same form without showing it, and Form.ToJson writes it out. A form saved this way can be reviewed, diffed and loaded again with Form.FromJson.
create = Interlude.Form.Create(title=string, elements=code_block_4)
toJson = Interlude.Form.ToJson(form=create)

# group: Read the answer
# Answers come back keyed by the field's key, whatever the form looked like.
getBool = Interlude.Result.GetBool(result=show.form, key=string_2)
