# Dynamo graph Interlude.Layout.Grid.dyn (Dynamo 4.2.0.5752)
# Interlude.Layout.Grid: elements placed by row and column.
# packages: Interlude 1.0.4

# group: Describe the field
# Places elements by row and column, each wrapped in a Layout.Cell. columns is a Dynamo-style width list: "*,*" splits the space evenly, "auto,*" sizes the first to its content.
code_block = CodeBlock { "Width"; 3.6; 0.1; 50; 0.1; 2; "m"; "width"; }
number = Interlude.Input.Number(label=code_block.out0, defaultValue=code_block.out1, minimum=code_block.out2, maximum=code_block.out3, increment=code_block.out4, decimalPlaces=code_block.out5, unit=code_block.out6, key=code_block.out7)
code_block_2 = CodeBlock { 0; 0; 1; 1; }
cell = Interlude.Layout.Cell(element=number, row=code_block_2.out0, column=code_block_2.out1, rowSpan=code_block_2.out2, columnSpan=code_block_2.out3)
code_block_3 = CodeBlock { "Depth"; 2.4; 0.1; 50; 0.1; 2; "m"; "depth"; }
number_2 = Interlude.Input.Number(label=code_block_3.out0, defaultValue=code_block_3.out1, minimum=code_block_3.out2, maximum=code_block_3.out3, increment=code_block_3.out4, decimalPlaces=code_block_3.out5, unit=code_block_3.out6, key=code_block_3.out7)
code_block_4 = CodeBlock { 0; 1; 1; 1; }
cell_2 = Interlude.Layout.Cell(element=number_2, row=code_block_4.out0, column=code_block_4.out1, rowSpan=code_block_4.out2, columnSpan=code_block_4.out3)
code_block_5 = CodeBlock(child0=cell, child1=cell_2) { [child0,child1]; }
code_block_6 = CodeBlock { "*,*"; 8.0; 8.0; }
grid = Interlude.Layout.Grid(elements=code_block_5, columns=code_block_6.out0, columnSpacing=code_block_6.out1, rowSpacing=code_block_6.out2)

# group: Show it
# trigger is false so the graph runs without opening the dialog: every field comes back with its default and buttonClicked reads "skipped". Set it to true to see the form.
string = StringInput("Room sizes")
code_block_7 = CodeBlock(field=grid) { [field]; }
boolean = BoolSelector(false)
show = Interlude.Form.Show(title=string, elements=code_block_7, trigger=boolean)
string_2 = StringInput("width")

# group: Keep it as a document
# Form.Create builds the same form without showing it, and Form.ToJson writes it out. A form saved this way can be reviewed, diffed and loaded again with Form.FromJson.
create = Interlude.Form.Create(title=string, elements=code_block_7)
toJson = Interlude.Form.ToJson(form=create)

# group: Read the answer
# Answers come back keyed by the field's key, whatever the form looked like.
getNumber = Interlude.Result.GetNumber(result=show.form, key=string_2)
