# Dynamo graph Interlude.Layout.Image.dyn (Dynamo 4.2.0.5752)
# Interlude.Layout.Image: a picture from disk.
# packages: Interlude 1.0.4

# group: Describe the field
# A picture from a path. width and height each take null to mean scale from the other, so a logo keeps its proportions.
code_block = CodeBlock { "logo.png"; 240; null; "Practice logo"; }
image = Interlude.Layout.Image(path=code_block.out0, width=code_block.out1, height=code_block.out2, alternateText=code_block.out3)

# group: Show it
# trigger is false so the graph runs without opening the dialog: every field comes back with its default and buttonClicked reads "skipped". Set it to true to see the form.
string = StringInput("Site survey")
code_block_2 = CodeBlock(field=image) { [field]; }
boolean = BoolSelector(false)
show = Interlude.Form.Show(title=string, elements=code_block_2, trigger=boolean)

# group: Keep it as a document
# Form.Create builds the same form without showing it, and Form.ToJson writes it out. A form saved this way can be reviewed, diffed and loaded again with Form.FromJson.
create = Interlude.Form.Create(title=string, elements=code_block_2)
toJson = Interlude.Form.ToJson(form=create)
