# Dynamo graph Interlude.Layout.Label.dyn (Dynamo 4.2.0.5752)
# Interlude.Layout.Label: a heading or a line of text.
# packages: Interlude 1.0.4

# group: Describe the field
# Text that asks nothing. headingLevel 0 is body text; 1 to 3 are headings, sized by the theme rather than by the graph.
code_block = CodeBlock { "Survey details"; 2; false; }
label = Interlude.Layout.Label(text=code_block.out0, headingLevel=code_block.out1, muted=code_block.out2)

# group: Show it
# trigger is false so the graph runs without opening the dialog: every field comes back with its default and buttonClicked reads "skipped". Set it to true to see the form.
string = StringInput("Site survey")
code_block_2 = CodeBlock(field=label) { [field]; }
boolean = BoolSelector(false)
show = Interlude.Form.Show(title=string, elements=code_block_2, trigger=boolean)

# group: Keep it as a document
# Form.Create builds the same form without showing it, and Form.ToJson writes it out. A form saved this way can be reviewed, diffed and loaded again with Form.FromJson.
create = Interlude.Form.Create(title=string, elements=code_block_2)
toJson = Interlude.Form.ToJson(form=create)
