# Dynamo graph Interlude.Layout.LinkButton.dyn (Dynamo 4.2.0.5752)
# Interlude.Layout.LinkButton: opens a link in the browser.
# packages: Interlude 1.1.1

# group: Describe the field
# Opens a link and leaves the form alone. Useful for the standard, the wiki page or the ticket that explains why the form asks what it asks.
code_block = CodeBlock { "Read the standard"; "https://dynamobim.org"; }
linkButton = Interlude.Layout.LinkButton(text=code_block.out0, url=code_block.out1)

# group: Show it
# trigger is false so the graph runs without opening the dialog: every field comes back with its default and buttonClicked reads "skipped". Set it to true to see the form.
string = StringInput("Site survey")
code_block_2 = CodeBlock(field=linkButton) { [field]; }
boolean = BoolSelector(false)
show = Interlude.Form.Show(title=string, elements=code_block_2, trigger=boolean)

# group: Keep it as a document
# Form.Create builds the same form without showing it, and Form.ToJson writes it out. A form saved this way can be reviewed, diffed and loaded again with Form.FromJson.
create = Interlude.Form.Create(title=string, elements=code_block_2)
toJson = Interlude.Form.ToJson(form=create)
