# Dynamo graph Interlude.Layout.Markdown.dyn (Dynamo 4.2.0.5752)
# Interlude.Layout.Markdown: formatted prose inside a form.
# packages: Interlude 1.0.5

# group: Describe the field
# Prose with formatting. Bold, italic, lists and links render; the rest is shown as written.
code_block = CodeBlock { "Levels are read from the **active model**. Close other documents before running."; }
markdown = Interlude.Layout.Markdown(text=code_block)

# group: Show it
# trigger is false so the graph runs without opening the dialog: every field comes back with its default and buttonClicked reads "skipped". Set it to true to see the form.
string = StringInput("Site survey")
code_block_2 = CodeBlock(field=markdown) { [field]; }
boolean = BoolSelector(false)
show = Interlude.Form.Show(title=string, elements=code_block_2, trigger=boolean)

# group: Keep it as a document
# Form.Create builds the same form without showing it, and Form.ToJson writes it out. A form saved this way can be reviewed, diffed and loaded again with Form.FromJson.
create = Interlude.Form.Create(title=string, elements=code_block_2)
toJson = Interlude.Form.ToJson(form=create)
