# Dynamo graph Interlude.Layout.Preview.dyn (Dynamo 4.2.0.5752)
# Interlude.Layout.Preview: shows a value back to the user without asking for it.
# packages: Interlude 1.0.4

# group: Describe the field
# Shows a value rather than asking for one. Wired to a computed value it becomes a live preview of what a rule is about to do.
code_block = CodeBlock { "New name"; "L01-A-101"; "Nothing to show yet"; true; }
preview = Interlude.Layout.Preview(label=code_block.out0, value=code_block.out1, placeholder=code_block.out2, monospaced=code_block.out3)

# group: Show it
# trigger is false so the graph runs without opening the dialog: every field comes back with its default and buttonClicked reads "skipped". Set it to true to see the form.
string = StringInput("Rename views")
code_block_2 = CodeBlock(field=preview) { [field]; }
boolean = BoolSelector(false)
show = Interlude.Form.Show(title=string, elements=code_block_2, trigger=boolean)

# group: Keep it as a document
# Form.Create builds the same form without showing it, and Form.ToJson writes it out. A form saved this way can be reviewed, diffed and loaded again with Form.FromJson.
create = Interlude.Form.Create(title=string, elements=code_block_2)
toJson = Interlude.Form.ToJson(form=create)
