# Dynamo graph Interlude.Layout.Progress.dyn (Dynamo 4.2.0.5752)
# Interlude.Layout.Progress: a progress bar.
# packages: Interlude 1.0.5

# group: Describe the field
# A progress bar. It shows a value rather than tracking work: a form is answered and then closed, so this reports where a longer job has got to.
code_block = CodeBlock { 3.0; 5.0; false; 5; }
progress = Interlude.Layout.Progress(value=code_block.out0, maximum=code_block.out1, indeterminate=code_block.out2, segments=code_block.out3)

# group: Show it
# trigger is false so the graph runs without opening the dialog: every field comes back with its default and buttonClicked reads "skipped". Set it to true to see the form.
string = StringInput("Export")
code_block_2 = CodeBlock(field=progress) { [field]; }
boolean = BoolSelector(false)
show = Interlude.Form.Show(title=string, elements=code_block_2, trigger=boolean)

# group: Keep it as a document
# Form.Create builds the same form without showing it, and Form.ToJson writes it out. A form saved this way can be reviewed, diffed and loaded again with Form.FromJson.
create = Interlude.Form.Create(title=string, elements=code_block_2)
toJson = Interlude.Form.ToJson(form=create)
