# Dynamo graph Interlude.Layout.Row.dyn (Dynamo 4.2.0.5752)
# Interlude.Layout.Row: elements side by side.
# packages: Interlude 1.1.1

# group: Describe the field
# Puts elements side by side. equalWidths divides the space evenly, which is what makes a row of paired fields line up.
code_block = CodeBlock { "Width"; 3.6; 0.1; 50; 0.1; 2; "m"; "width"; }
number = Interlude.Input.Number(label=code_block.out0, defaultValue=code_block.out1, minimum=code_block.out2, maximum=code_block.out3, increment=code_block.out4, decimalPlaces=code_block.out5, unit=code_block.out6, key=code_block.out7)
code_block_2 = CodeBlock { "Depth"; 2.4; 0.1; 50; 0.1; 2; "m"; "depth"; }
number_2 = Interlude.Input.Number(label=code_block_2.out0, defaultValue=code_block_2.out1, minimum=code_block_2.out2, maximum=code_block_2.out3, increment=code_block_2.out4, decimalPlaces=code_block_2.out5, unit=code_block_2.out6, key=code_block_2.out7)
code_block_3 = CodeBlock(child0=number, child1=number_2) { [child0,child1]; }
code_block_4 = CodeBlock { true; false; 8.0; }
row = Interlude.Layout.Row(elements=code_block_3, equalWidths=code_block_4.out0, wrap=code_block_4.out1, spacing=code_block_4.out2)

# group: Show it
# trigger is false so the graph runs without opening the dialog: every field comes back with its default and buttonClicked reads "skipped". Set it to true to see the form.
string = StringInput("Room sizes")
code_block_5 = CodeBlock(field=row) { [field]; }
boolean = BoolSelector(false)
show = Interlude.Form.Show(title=string, elements=code_block_5, trigger=boolean)
string_2 = StringInput("width")

# group: Keep it as a document
# Form.Create builds the same form without showing it, and Form.ToJson writes it out. A form saved this way can be reviewed, diffed and loaded again with Form.FromJson.
create = Interlude.Form.Create(title=string, elements=code_block_5)
toJson = Interlude.Form.ToJson(form=create)

# group: Read the answer
# Answers come back keyed by the field's key, whatever the form looked like.
getNumber = Interlude.Result.GetNumber(result=show.form, key=string_2)
