# Dynamo graph Interlude.Layout.Scroll.dyn (Dynamo 4.2.0.5752)
# Interlude.Layout.Scroll: a part of the form that scrolls on its own.
# packages: Interlude 1.1.2

# group: Describe the field
# Scrolls one part of the form rather than the window. The form maxHeight handles the usual case; this is for a long list inside an otherwise short form.
code_block = CodeBlock { "Notes"; ""; 12; ""; "notes"; }
textArea = Interlude.Input.TextArea(label=code_block.out0, defaultValue=code_block.out1, lines=code_block.out2, placeholder=code_block.out3, key=code_block.out4)
code_block_2 = CodeBlock(child0=textArea) { [child0]; }
code_block_3 = CodeBlock { 200.0; false; }
scroll = Interlude.Layout.Scroll(elements=code_block_2, maxHeight=code_block_3.out0, allowHorizontal=code_block_3.out1)

# group: Show it
# trigger is false so the graph runs without opening the dialog: every field comes back with its default and buttonClicked reads "skipped". Set it to true to see the form.
string = StringInput("Site survey")
code_block_4 = CodeBlock(field=scroll) { [field]; }
boolean = BoolSelector(false)
show = Interlude.Form.Show(title=string, elements=code_block_4, trigger=boolean)
string_2 = StringInput("notes")

# group: Keep it as a document
# Form.Create builds the same form without showing it, and Form.ToJson writes it out. A form saved this way can be reviewed, diffed and loaded again with Form.FromJson.
create = Interlude.Form.Create(title=string, elements=code_block_4)
toJson = Interlude.Form.ToJson(form=create)

# group: Read the answer
# Answers come back keyed by the field's key, whatever the form looked like.
getString = Interlude.Result.GetString(result=show.form, key=string_2)
