# Dynamo graph Interlude.Layout.Section.dyn (Dynamo 4.2.0.5752)
# Interlude.Layout.Section: a titled group of fields.
# packages: Interlude 1.1.1

# group: Describe the field
# Divides a form into named parts. Collapsible sections let a long form open showing only what usually matters.
code_block = CodeBlock { "Project"; true; true; }
code_block_2 = CodeBlock { "Project name"; "Tower A"; ""; "projectName"; }
textBox = Interlude.Input.TextBox(label=code_block_2.out0, defaultValue=code_block_2.out1, placeholder=code_block_2.out2, key=code_block_2.out3)
code_block_3 = CodeBlock { "Storeys"; 12; 1; 60; 1; ""; "storeys"; }
integer = Interlude.Input.Integer(label=code_block_3.out0, defaultValue=code_block_3.out1, minimum=code_block_3.out2, maximum=code_block_3.out3, increment=code_block_3.out4, unit=code_block_3.out5, key=code_block_3.out6)
code_block_4 = CodeBlock(child0=textBox, child1=integer) { [child0,child1]; }
section = Interlude.Layout.Section(header=code_block.out0, elements=code_block_4, collapsible=code_block.out1, expanded=code_block.out2)

# group: Show it
# trigger is false so the graph runs without opening the dialog: every field comes back with its default and buttonClicked reads "skipped". Set it to true to see the form.
string = StringInput("Site survey")
code_block_5 = CodeBlock(field=section) { [field]; }
boolean = BoolSelector(false)
show = Interlude.Form.Show(title=string, elements=code_block_5, trigger=boolean)
string_2 = StringInput("projectName")

# group: Keep it as a document
# Form.Create builds the same form without showing it, and Form.ToJson writes it out. A form saved this way can be reviewed, diffed and loaded again with Form.FromJson.
create = Interlude.Form.Create(title=string, elements=code_block_5)
toJson = Interlude.Form.ToJson(form=create)

# group: Read the answer
# Answers come back keyed by the field's key, whatever the form looked like.
getString = Interlude.Result.GetString(result=show.form, key=string_2)
