# Dynamo graph Interlude.Layout.Spacer.dyn (Dynamo 4.2.0.5752)
# Interlude.Layout.Spacer: a fixed gap.
# packages: Interlude 1.1.2

# group: Describe the field
# A gap of a fixed size. Reach for it when the spacing the theme gives is right everywhere except one place.
code_block = CodeBlock { 24.0; }
spacer = Interlude.Layout.Spacer(size=code_block)

# group: Show it
# trigger is false so the graph runs without opening the dialog: every field comes back with its default and buttonClicked reads "skipped". Set it to true to see the form.
string = StringInput("Site survey")
code_block_2 = CodeBlock(field=spacer) { [field]; }
boolean = BoolSelector(false)
show = Interlude.Form.Show(title=string, elements=code_block_2, trigger=boolean)

# group: Keep it as a document
# Form.Create builds the same form without showing it, and Form.ToJson writes it out. A form saved this way can be reviewed, diffed and loaded again with Form.FromJson.
create = Interlude.Form.Create(title=string, elements=code_block_2)
toJson = Interlude.Form.ToJson(form=create)
