# Dynamo graph Interlude.Layout.Split.dyn (Dynamo 4.2.0.5752)
# Interlude.Layout.Split: two panes with a divider the user can drag.
# packages: Interlude 1.1.1

# group: Describe the field
# Two panes and a draggable divider. position is the fraction the first pane starts with, not a pixel count, so it survives a resized window.
code_block = CodeBlock { "Levels"; ["Level 00","Level 01","Roof"]; }
listBox = Interlude.Input.ListBox(label=code_block.out0, items=code_block.out1)
code_block_2 = CodeBlock { "Selected"; "Level 00"; ""; true; }
preview = Interlude.Layout.Preview(label=code_block_2.out0, value=code_block_2.out1, placeholder=code_block_2.out2, monospaced=code_block_2.out3)
code_block_3 = CodeBlock { true; 0.4; }
split = Interlude.Layout.Split(first=listBox, second=preview, horizontal=code_block_3.out0, position=code_block_3.out1)

# group: Show it
# trigger is false so the graph runs without opening the dialog: every field comes back with its default and buttonClicked reads "skipped". Set it to true to see the form.
string = StringInput("Level picker")
code_block_4 = CodeBlock(field=split) { [field]; }
boolean = BoolSelector(false)
show = Interlude.Form.Show(title=string, elements=code_block_4, trigger=boolean)

# group: Keep it as a document
# Form.Create builds the same form without showing it, and Form.ToJson writes it out. A form saved this way can be reviewed, diffed and loaded again with Form.FromJson.
create = Interlude.Form.Create(title=string, elements=code_block_4)
toJson = Interlude.Form.ToJson(form=create)
