# Dynamo graph Interlude.Layout.TabPage.dyn (Dynamo 4.2.0.5752)
# Interlude.Layout.TabPage: one page of a Tabs container.
# packages: Interlude 1.0.4

# group: Describe the field
# One page of a Layout.Tabs. Shown here on its own, which a form will accept: a page outside a tab strip just renders its contents.
code_block = CodeBlock { "General"; }
code_block_2 = CodeBlock { "Project name"; "Tower A"; ""; "projectName"; }
textBox = Interlude.Input.TextBox(label=code_block_2.out0, defaultValue=code_block_2.out1, placeholder=code_block_2.out2, key=code_block_2.out3)
code_block_3 = CodeBlock(child0=textBox) { [child0]; }
tabPage = Interlude.Layout.TabPage(header=code_block, elements=code_block_3)

# group: Show it
# trigger is false so the graph runs without opening the dialog: every field comes back with its default and buttonClicked reads "skipped". Set it to true to see the form.
string = StringInput("Settings")
code_block_4 = CodeBlock(field=tabPage) { [field]; }
boolean = BoolSelector(false)
show = Interlude.Form.Show(title=string, elements=code_block_4, trigger=boolean)
string_2 = StringInput("projectName")

# group: Keep it as a document
# Form.Create builds the same form without showing it, and Form.ToJson writes it out. A form saved this way can be reviewed, diffed and loaded again with Form.FromJson.
create = Interlude.Form.Create(title=string, elements=code_block_4)
toJson = Interlude.Form.ToJson(form=create)

# group: Read the answer
# Answers come back keyed by the field's key, whatever the form looked like.
getString = Interlude.Result.GetString(result=show.form, key=string_2)
