# Dynamo graph Interlude.Layout.Tabs.dyn (Dynamo 4.2.0.5752)
# Interlude.Layout.Tabs: pages of a form behind a tab strip.
# packages: Interlude 1.1.2

# group: Describe the field
# Pages behind a tab strip, each one a Layout.TabPage. Every page's fields are answered whether or not the user visited it, so a required field on a tab nobody opened still stops the form.
code_block = CodeBlock { "General"; }
code_block_2 = CodeBlock { "Project name"; "Tower A"; ""; "projectName"; }
textBox = Interlude.Input.TextBox(label=code_block_2.out0, defaultValue=code_block_2.out1, placeholder=code_block_2.out2, key=code_block_2.out3)
code_block_3 = CodeBlock(child0=textBox) { [child0]; }
tabPage = Interlude.Layout.TabPage(header=code_block, elements=code_block_3)
code_block_4 = CodeBlock { "Advanced"; }
code_block_5 = CodeBlock { "Overwrite existing"; false; "overwrite"; }
checkBox = Interlude.Input.CheckBox(label=code_block_5.out0, defaultValue=code_block_5.out1, key=code_block_5.out2)
code_block_6 = CodeBlock(child0=checkBox) { [child0]; }
tabPage_2 = Interlude.Layout.TabPage(header=code_block_4, elements=code_block_6)
code_block_7 = CodeBlock(child0=tabPage, child1=tabPage_2) { [child0,child1]; }
code_block_8 = CodeBlock { 0; }
tabs = Interlude.Layout.Tabs(pages=code_block_7, selectedIndex=code_block_8)

# group: Show it
# trigger is false so the graph runs without opening the dialog: every field comes back with its default and buttonClicked reads "skipped". Set it to true to see the form.
string = StringInput("Settings")
code_block_9 = CodeBlock(field=tabs) { [field]; }
boolean = BoolSelector(false)
show = Interlude.Form.Show(title=string, elements=code_block_9, trigger=boolean)
string_2 = StringInput("projectName")

# group: Keep it as a document
# Form.Create builds the same form without showing it, and Form.ToJson writes it out. A form saved this way can be reviewed, diffed and loaded again with Form.FromJson.
create = Interlude.Form.Create(title=string, elements=code_block_9)
toJson = Interlude.Form.ToJson(form=create)

# group: Read the answer
# Answers come back keyed by the field's key, whatever the form looked like.
getString = Interlude.Result.GetString(result=show.form, key=string_2)
