# Dynamo graph Interlude.Result.GetBool.dyn (Dynamo 4.2.0.5752)
# Interlude.Result.GetBool: one answer as true or false.
# packages: Interlude 1.0.5

# group: Describe the field
# What the form holds, built left to right: literals into a code block, the code block into a node, and the nodes gathered into the list Form.Show takes.
code_block = CodeBlock { "Include basement"; true; "includeBasement"; }
checkBox = Interlude.Input.CheckBox(label=code_block.out0, defaultValue=code_block.out1, key=code_block.out2)

# group: Show it
# trigger is false so the graph runs without opening the dialog: every field comes back with its default and buttonClicked reads "skipped". Set it to true to see the form.
string = StringInput("Site survey")
code_block_2 = CodeBlock(field=checkBox) { [field]; }
boolean = BoolSelector(false)
show = Interlude.Form.Show(title=string, elements=code_block_2, trigger=boolean)
string_2 = StringInput("includeBasement")

# group: Keep it as a document
# Form.Create builds the same form without showing it, and Form.ToJson writes it out. A form saved this way can be reviewed, diffed and loaded again with Form.FromJson.
create = Interlude.Form.Create(title=string, elements=code_block_2)
toJson = Interlude.Form.ToJson(form=create)

# group: Read the answer
# For a tick box or a switch. It also reads "true", "yes" and 1 as true, which is what makes a form loaded from JSON behave the same as one built in the graph.
getBool = Interlude.Result.GetBool(result=show.form, key=string_2)
