# Dynamo graph Interlude.Result.GetColor.dyn (Dynamo 4.2.0.5752)
# Interlude.Result.GetColor: one answer as a Dynamo colour.
# packages: Interlude 1.1.2

# group: Describe the field
# What the form holds, built left to right: literals into a code block, the code block into a node, and the nodes gathered into the list Form.Show takes.
code_block = CodeBlock { "Zone colour"; "#E8734A"; false; ["#E8734A","#4A90D9","#7CB342"]; "zoneColour"; }
colorPicker = Interlude.Input.ColorPicker(label=code_block.out0, defaultValue=code_block.out1, showAlpha=code_block.out2, presets=code_block.out3, key=code_block.out4)

# group: Show it
# trigger is false so the graph runs without opening the dialog: every field comes back with its default and buttonClicked reads "skipped". Set it to true to see the form.
string = StringInput("Zoning")
code_block_2 = CodeBlock(field=colorPicker) { [field]; }
boolean = BoolSelector(false)
show = Interlude.Form.Show(title=string, elements=code_block_2, trigger=boolean)
string_2 = StringInput("zoneColour")

# group: Keep it as a document
# Form.Create builds the same form without showing it, and Form.ToJson writes it out. A form saved this way can be reviewed, diffed and loaded again with Form.FromJson.
create = Interlude.Form.Create(title=string, elements=code_block_2)
toJson = Interlude.Form.ToJson(form=create)

# group: Read the answer
# A real colour rather than the hex string the form stores, so it goes straight into a Revit override or a display node without a conversion in between.
getColor = Interlude.Result.GetColor(result=show.form, key=string_2)
