# Dynamo graph Interlude.Result.GetFilePaths.dyn (Dynamo 4.2.0.5752)
# Interlude.Result.GetFilePaths: one answer as a list of file paths.
# packages: Interlude 1.1.2

# group: Describe the field
# What the form holds, built left to right: literals into a code block, the code block into a node, and the nodes gathered into the list Form.Show takes.
code_block = CodeBlock { "Linked models"; ""; "Revit model (*.rvt)|*.rvt"; true; false; "linkedModels"; }
filePath = Interlude.Input.FilePath(label=code_block.out0, defaultValue=code_block.out1, filter=code_block.out2, allowMultiple=code_block.out3, forSaving=code_block.out4, key=code_block.out5)

# group: Show it
# trigger is false so the graph runs without opening the dialog: every field comes back with its default and buttonClicked reads "skipped". Set it to true to see the form.
string = StringInput("Model audit")
code_block_2 = CodeBlock(field=filePath) { [field]; }
boolean = BoolSelector(false)
show = Interlude.Form.Show(title=string, elements=code_block_2, trigger=boolean)
string_2 = StringInput("linkedModels")

# group: Keep it as a document
# Form.Create builds the same form without showing it, and Form.ToJson writes it out. A form saved this way can be reviewed, diffed and loaded again with Form.FromJson.
create = Interlude.Form.Create(title=string, elements=code_block_2)
toJson = Interlude.Form.ToJson(form=create)

# group: Read the answer
# Result.GetList for the path fields, with the blanks dropped. A file field set to allowMultiple is the case it exists for; on a single file it still hands back a list of one.
getFilePaths = Interlude.Result.GetFilePaths(result=show.form, key=string_2)
