# Dynamo graph Interlude.Result.GetInteger.dyn (Dynamo 4.2.0.5752)
# Interlude.Result.GetInteger: one answer as a whole number.
# packages: Interlude 1.0.4

# group: Describe the field
# What the form holds, built left to right: literals into a code block, the code block into a node, and the nodes gathered into the list Form.Show takes.
code_block = CodeBlock { "Storeys"; 12; 1; 60; 1; ""; "storeys"; }
integer = Interlude.Input.Integer(label=code_block.out0, defaultValue=code_block.out1, minimum=code_block.out2, maximum=code_block.out3, increment=code_block.out4, unit=code_block.out5, key=code_block.out6)

# group: Show it
# trigger is false so the graph runs without opening the dialog: every field comes back with its default and buttonClicked reads "skipped". Set it to true to see the form.
string = StringInput("Site survey")
code_block_2 = CodeBlock(field=integer) { [field]; }
boolean = BoolSelector(false)
show = Interlude.Form.Show(title=string, elements=code_block_2, trigger=boolean)
string_2 = StringInput("storeys")

# group: Keep it as a document
# Form.Create builds the same form without showing it, and Form.ToJson writes it out. A form saved this way can be reviewed, diffed and loaded again with Form.FromJson.
create = Interlude.Form.Create(title=string, elements=code_block_2)
toJson = Interlude.Form.ToJson(form=create)

# group: Read the answer
# Result.GetNumber rounded to the nearest whole number, away from zero at the halfway point. Worth using over GetNumber wherever the answer counts things, so that downstream nodes taking an integer port get one.
getInteger = Interlude.Result.GetInteger(result=show.form, key=string_2)
