# Dynamo graph Interlude.Result.GetNumber.dyn (Dynamo 4.2.0.5752)
# Interlude.Result.GetNumber: one answer as a decimal number.
# packages: Interlude 1.0.4

# group: Describe the field
# What the form holds, built left to right: literals into a code block, the code block into a node, and the nodes gathered into the list Form.Show takes.
code_block = CodeBlock { "Floor to floor"; 3.6; 2.4; 6; 0.1; 2; "m"; "floorToFloor"; }
number = Interlude.Input.Number(label=code_block.out0, defaultValue=code_block.out1, minimum=code_block.out2, maximum=code_block.out3, increment=code_block.out4, decimalPlaces=code_block.out5, unit=code_block.out6, key=code_block.out7)

# group: Show it
# trigger is false so the graph runs without opening the dialog: every field comes back with its default and buttonClicked reads "skipped". Set it to true to see the form.
string = StringInput("Site survey")
code_block_2 = CodeBlock(field=number) { [field]; }
boolean = BoolSelector(false)
show = Interlude.Form.Show(title=string, elements=code_block_2, trigger=boolean)
string_2 = StringInput("floorToFloor")

# group: Keep it as a document
# Form.Create builds the same form without showing it, and Form.ToJson writes it out. A form saved this way can be reviewed, diffed and loaded again with Form.FromJson.
create = Interlude.Form.Create(title=string, elements=code_block_2)
toJson = Interlude.Form.ToJson(form=create)

# group: Read the answer
# Anything that reads as a number comes back as one, including a number typed into a text field. Anything that does not comes back as the fallback rather than as an error, so one odd answer does not stop the graph.
getNumber = Interlude.Result.GetNumber(result=show.form, key=string_2)
