# Dynamo graph Interlude.Result.GetString.dyn (Dynamo 4.2.0.5752)
# Interlude.Result.GetString: one answer as text.
# packages: Interlude 1.1.1

# group: Describe the field
# What the form holds, built left to right: literals into a code block, the code block into a node, and the nodes gathered into the list Form.Show takes.
code_block = CodeBlock { "Project name"; "Tower A"; "As it appears on the drawing"; "projectName"; }
textBox = Interlude.Input.TextBox(label=code_block.out0, defaultValue=code_block.out1, placeholder=code_block.out2, key=code_block.out3)

# group: Show it
# trigger is false so the graph runs without opening the dialog: every field comes back with its default and buttonClicked reads "skipped". Set it to true to see the form.
string = StringInput("Site survey")
code_block_2 = CodeBlock(field=textBox) { [field]; }
boolean = BoolSelector(false)
show = Interlude.Form.Show(title=string, elements=code_block_2, trigger=boolean)
string_2 = StringInput("projectName")

# group: Keep it as a document
# Form.Create builds the same form without showing it, and Form.ToJson writes it out. A form saved this way can be reviewed, diffed and loaded again with Form.FromJson.
create = Interlude.Form.Create(title=string, elements=code_block_2)
toJson = Interlude.Form.ToJson(form=create)

# group: Read the answer
# The reader to reach for first: almost every field has a sensible text form, and this is it. An empty answer comes back as the fallback rather than as an empty string, so a missing answer and a blank one can be told apart.
getString = Interlude.Result.GetString(result=show.form, key=string_2)
