# Dynamo graph Interlude.Result.HasKey.dyn (Dynamo 4.2.0.5752)
# Interlude.Result.HasKey: whether the form answered under that key at all.
# packages: Interlude 1.1.1

# group: Describe the field
# What the form holds, built left to right: literals into a code block, the code block into a node, and the nodes gathered into the list Form.Show takes.
code_block = CodeBlock { "Sheet prefix"; "A-"; ""; "sheetPrefix"; }
textBox = Interlude.Input.TextBox(label=code_block.out0, defaultValue=code_block.out1, placeholder=code_block.out2, key=code_block.out3)

# group: Show it
# trigger is false so the graph runs without opening the dialog: every field comes back with its default and buttonClicked reads "skipped". Set it to true to see the form.
string = StringInput("Export")
code_block_2 = CodeBlock(field=textBox) { [field]; }
boolean = BoolSelector(false)
show = Interlude.Form.Show(title=string, elements=code_block_2, trigger=boolean)
string_2 = StringInput("sheetPrefix")

# group: Keep it as a document
# Form.Create builds the same form without showing it, and Form.ToJson writes it out. A form saved this way can be reviewed, diffed and loaded again with Form.FromJson.
create = Interlude.Form.Create(title=string, elements=code_block_2)
toJson = Interlude.Form.ToJson(form=create)

# group: Read the answer
# Different from an empty answer: a key is missing when the form never had that field, and empty when it had it and nobody filled it in. Worth checking on a form loaded from JSON, where the file decides which fields exist.
hasKey = Interlude.Result.HasKey(result=show.form, key=string_2)
