# Dynamo graph Interlude.Result.Keys.dyn (Dynamo 4.2.0.5752)
# Interlude.Result.Keys: every key the form answered under.
# packages: Interlude 1.0.4

# group: Describe the field
# What the form holds, built left to right: literals into a code block, the code block into a node, and the nodes gathered into the list Form.Show takes.
code_block = CodeBlock { "Project name"; "Tower A"; ""; "projectName"; }
textBox = Interlude.Input.TextBox(label=code_block.out0, defaultValue=code_block.out1, placeholder=code_block.out2, key=code_block.out3)
code_block_2 = CodeBlock { "Include basement"; true; "includeBasement"; }
checkBox = Interlude.Input.CheckBox(label=code_block_2.out0, defaultValue=code_block_2.out1, key=code_block_2.out2)
code_block_3 = CodeBlock(child0=textBox, child1=checkBox) { [child0,child1]; }
code_block_4 = CodeBlock { 8.0; }
column = Interlude.Layout.Column(elements=code_block_3, spacing=code_block_4)

# group: Show it
# trigger is false so the graph runs without opening the dialog: every field comes back with its default and buttonClicked reads "skipped". Set it to true to see the form.
string = StringInput("Site survey")
code_block_5 = CodeBlock(field=column) { [field]; }
boolean = BoolSelector(false)
show = Interlude.Form.Show(title=string, elements=code_block_5, trigger=boolean)

# group: Keep it as a document
# Form.Create builds the same form without showing it, and Form.ToJson writes it out. A form saved this way can be reviewed, diffed and loaded again with Form.FromJson.
create = Interlude.Form.Create(title=string, elements=code_block_5)
toJson = Interlude.Form.ToJson(form=create)

# group: Read the answer
# The whole set, sorted, without naming any of them in the graph. This is how a graph handles a form it did not build — from JSON, or one still being designed — and it pairs with Result.Values, which returns them in the same order.
keys = Interlude.Result.Keys(result=show.form)
