# Dynamo graph Interlude.Result.ValueByKey.dyn (Dynamo 4.2.0.5752)
# Interlude.Result.ValueByKey: one answer exactly as the form stored it.
# packages: Interlude 1.1.2

# group: Describe the field
# What the form holds, built left to right: literals into a code block, the code block into a node, and the nodes gathered into the list Form.Show takes.
code_block = CodeBlock { "Discipline"; ["ARC","STR","MEP"]; ["Architectural","Structural","Services"]; "STR"; "Pick one"; "discipline"; }
dropDown = Interlude.Input.DropDown(label=code_block.out0, items=code_block.out1, displayNames=code_block.out2, defaultValue=code_block.out3, placeholder=code_block.out4, key=code_block.out5)

# group: Show it
# trigger is false so the graph runs without opening the dialog: every field comes back with its default and buttonClicked reads "skipped". Set it to true to see the form.
string = StringInput("Site survey")
code_block_2 = CodeBlock(field=dropDown) { [field]; }
boolean = BoolSelector(false)
show = Interlude.Form.Show(title=string, elements=code_block_2, trigger=boolean)
string_2 = StringInput("discipline")

# group: Keep it as a document
# Form.Create builds the same form without showing it, and Form.ToJson writes it out. A form saved this way can be reviewed, diffed and loaded again with Form.FromJson.
create = Interlude.Form.Create(title=string, elements=code_block_2)
toJson = Interlude.Form.ToJson(form=create)

# group: Read the answer
# No conversion at all, which is what the typed readers are built on. Use it when the answer should keep whatever shape it had; use one of the typed readers when the graph downstream needs a particular one.
valueByKey = Interlude.Result.ValueByKey(result=show.form, key=string_2)
