# Dynamo graph Interlude.Rule.CompareTo.dyn (Dynamo 4.2.0.5752)
# Interlude.Rule.CompareTo: the field must compare correctly against another field.
# packages: Interlude 1.0.4

# group: Describe the field
# The only rule that reads a second field, which is what makes "after the start date" expressible at all. It is checked on the field it is attached to, so the message appears under the end date rather than between the two.
code_block = CodeBlock { "Start date"; null; false; null; null; "startDate"; }
datePicker = Interlude.Input.DatePicker(label=code_block.out0, defaultValue=code_block.out1, includeTime=code_block.out2, minimum=code_block.out3, maximum=code_block.out4, key=code_block.out5)
code_block_2 = CodeBlock { "End date"; null; false; null; null; "endDate"; }
datePicker_2 = Interlude.Input.DatePicker(label=code_block_2.out0, defaultValue=code_block_2.out1, includeTime=code_block_2.out2, minimum=code_block_2.out3, maximum=code_block_2.out4, key=code_block_2.out5)
code_block_3 = CodeBlock { "startDate"; "GreaterThan"; "The end date must be after the start date"; }
compareTo = Interlude.Rule.CompareTo(otherKey=code_block_3.out0, operation=code_block_3.out1, message=code_block_3.out2)
code_block_4 = CodeBlock(item0=compareTo) { [item0]; }
withValidation = Interlude.Behavior.WithValidation(element=datePicker_2, rule=code_block_4)
code_block_5 = CodeBlock(child0=datePicker, child1=withValidation) { [child0,child1]; }
code_block_6 = CodeBlock { 8.0; }
column = Interlude.Layout.Column(elements=code_block_5, spacing=code_block_6)

# group: Show it
# trigger is false so the graph runs without opening the dialog: every field comes back with its default and buttonClicked reads "skipped". Set it to true to see the form.
string = StringInput("Site survey")
code_block_7 = CodeBlock(field=column) { [field]; }
boolean = BoolSelector(false)
show = Interlude.Form.Show(title=string, elements=code_block_7, trigger=boolean)
string_2 = StringInput("endDate")

# group: Keep it as a document
# Form.Create builds the same form without showing it, and Form.ToJson writes it out. A form saved this way can be reviewed, diffed and loaded again with Form.FromJson.
create = Interlude.Form.Create(title=string, elements=code_block_7)
toJson = Interlude.Form.ToJson(form=create)

# group: Read the answer
# Answers come back keyed by the field's key, whatever the form looked like.
getDate = Interlude.Result.GetDate(result=show.form, key=string_2)
