# Dynamo graph Interlude.Rule.FileExists.dyn (Dynamo 4.2.0.5752)
# Interlude.Rule.FileExists: the file the field holds must exist on disk.
# packages: Interlude 1.1.2

# group: Describe the field
# A path typed rather than browsed to, or one browsed to last week and moved since, both come back as text that looks fine. This is what checks the disk before the graph tries to open it.
code_block = CodeBlock { "Template file"; ""; "Revit template (*.rte)|*.rte"; false; false; "templateFile"; }
filePath = Interlude.Input.FilePath(label=code_block.out0, defaultValue=code_block.out1, filter=code_block.out2, allowMultiple=code_block.out3, forSaving=code_block.out4, key=code_block.out5)
code_block_2 = CodeBlock { "Pick a template that exists"; }
fileExists = Interlude.Rule.FileExists(message=code_block_2)
code_block_3 = CodeBlock(item0=fileExists) { [item0]; }
withValidation = Interlude.Behavior.WithValidation(element=filePath, rule=code_block_3)

# group: Show it
# trigger is false so the graph runs without opening the dialog: every field comes back with its default and buttonClicked reads "skipped". Set it to true to see the form.
string = StringInput("Export")
code_block_4 = CodeBlock(field=withValidation) { [field]; }
boolean = BoolSelector(false)
show = Interlude.Form.Show(title=string, elements=code_block_4, trigger=boolean)
string_2 = StringInput("templateFile")

# group: Keep it as a document
# Form.Create builds the same form without showing it, and Form.ToJson writes it out. A form saved this way can be reviewed, diffed and loaded again with Form.FromJson.
create = Interlude.Form.Create(title=string, elements=code_block_4)
toJson = Interlude.Form.ToJson(form=create)

# group: Read the answer
# Answers come back keyed by the field's key, whatever the form looked like.
getString = Interlude.Result.GetString(result=show.form, key=string_2)
