# Dynamo graph Interlude.Rule.FolderExists.dyn (Dynamo 4.2.0.5752)
# Interlude.Rule.FolderExists: the folder the field holds must exist on disk.
# packages: Interlude 1.1.1

# group: Describe the field
# The Input.DirectoryPath half of Rule.FileExists. Worth adding whenever the graph is about to write into whatever comes back, which is most of the time.
code_block = CodeBlock { "Output folder"; ""; "outputFolder"; }
directoryPath = Interlude.Input.DirectoryPath(label=code_block.out0, defaultValue=code_block.out1, key=code_block.out2)
code_block_2 = CodeBlock { "Pick a folder that exists"; }
folderExists = Interlude.Rule.FolderExists(message=code_block_2)
code_block_3 = CodeBlock(item0=folderExists) { [item0]; }
withValidation = Interlude.Behavior.WithValidation(element=directoryPath, rule=code_block_3)

# group: Show it
# trigger is false so the graph runs without opening the dialog: every field comes back with its default and buttonClicked reads "skipped". Set it to true to see the form.
string = StringInput("Export")
code_block_4 = CodeBlock(field=withValidation) { [field]; }
boolean = BoolSelector(false)
show = Interlude.Form.Show(title=string, elements=code_block_4, trigger=boolean)
string_2 = StringInput("outputFolder")

# group: Keep it as a document
# Form.Create builds the same form without showing it, and Form.ToJson writes it out. A form saved this way can be reviewed, diffed and loaded again with Form.FromJson.
create = Interlude.Form.Create(title=string, elements=code_block_4)
toJson = Interlude.Form.ToJson(form=create)

# group: Read the answer
# Answers come back keyed by the field's key, whatever the form looked like.
getString = Interlude.Result.GetString(result=show.form, key=string_2)
