# Dynamo graph Interlude.Rule.Length.dyn (Dynamo 4.2.0.5752)
# Interlude.Rule.Length: checks how many characters an answer has.
# packages: Interlude 1.0.5

# group: Describe the field
# A rule is an ingredient: Behavior.WithValidation is what applies it to a field. minimum and maximum each take null to mean unbounded, so this is also how to write "at least six characters" on its own.
code_block = CodeBlock { "Project code"; "AB"; "Six to ten characters"; "projectCode"; }
textBox = Interlude.Input.TextBox(label=code_block.out0, defaultValue=code_block.out1, placeholder=code_block.out2, key=code_block.out3)
code_block_2 = CodeBlock { 6; 10; "Between six and ten characters"; }
length = Interlude.Rule.Length(minimum=code_block_2.out0, maximum=code_block_2.out1, message=code_block_2.out2)
code_block_3 = CodeBlock(item0=length) { [item0]; }
withValidation = Interlude.Behavior.WithValidation(element=textBox, rule=code_block_3)

# group: Show it
# trigger is false so the graph runs without opening the dialog: every field comes back with its default and buttonClicked reads "skipped". Set it to true to see the form.
string = StringInput("Site survey")
code_block_4 = CodeBlock(field=withValidation) { [field]; }
boolean = BoolSelector(false)
show = Interlude.Form.Show(title=string, elements=code_block_4, trigger=boolean)
string_2 = StringInput("projectCode")

# group: Keep it as a document
# Form.Create builds the same form without showing it, and Form.ToJson writes it out. A form saved this way can be reviewed, diffed and loaded again with Form.FromJson.
create = Interlude.Form.Create(title=string, elements=code_block_4)
toJson = Interlude.Form.ToJson(form=create)

# group: Read the answer
# Answers come back keyed by the field's key, whatever the form looked like.
getString = Interlude.Result.GetString(result=show.form, key=string_2)
