# Dynamo graph Interlude.Rule.Range.dyn (Dynamo 4.2.0.5752)
# Interlude.Rule.Range: the field's number must fall between two bounds.
# packages: Interlude 1.0.5

# group: Describe the field
# Either bound takes null to mean unbounded, so this is also how to write "at least 2.4" on its own. The bounds on Input.Number stop the spinner; these stop the form, which is what catches a number that was typed rather than stepped.
code_block = CodeBlock { "Floor to floor"; 3.6; 0; 20; 0.1; 2; "m"; "floorToFloor"; }
number = Interlude.Input.Number(label=code_block.out0, defaultValue=code_block.out1, minimum=code_block.out2, maximum=code_block.out3, increment=code_block.out4, decimalPlaces=code_block.out5, unit=code_block.out6, key=code_block.out7)
code_block_2 = CodeBlock { 2.4; 6; "Between 2.4 and 6.0 metres"; }
range = Interlude.Rule.Range(minimum=code_block_2.out0, maximum=code_block_2.out1, message=code_block_2.out2)
code_block_3 = CodeBlock(item0=range) { [item0]; }
withValidation = Interlude.Behavior.WithValidation(element=number, rule=code_block_3)

# group: Show it
# trigger is false so the graph runs without opening the dialog: every field comes back with its default and buttonClicked reads "skipped". Set it to true to see the form.
string = StringInput("Site survey")
code_block_4 = CodeBlock(field=withValidation) { [field]; }
boolean = BoolSelector(false)
show = Interlude.Form.Show(title=string, elements=code_block_4, trigger=boolean)
string_2 = StringInput("floorToFloor")

# group: Keep it as a document
# Form.Create builds the same form without showing it, and Form.ToJson writes it out. A form saved this way can be reviewed, diffed and loaded again with Form.FromJson.
create = Interlude.Form.Create(title=string, elements=code_block_4)
toJson = Interlude.Form.ToJson(form=create)

# group: Read the answer
# Answers come back keyed by the field's key, whatever the form looked like.
getNumber = Interlude.Result.GetNumber(result=show.form, key=string_2)
