# Dynamo graph Interlude.Rule.Regex.dyn (Dynamo 4.2.0.5752)
# Interlude.Rule.Regex: the field's answer must match a regular expression.
# packages: Interlude 1.0.4

# group: Describe the field
# Worth a message that says what the pattern wants in words: a reader who has just failed a validation is not in a position to read the expression that failed them.
code_block = CodeBlock { "Sheet number"; "A-101"; "A letter, a dash, three digits"; "sheetNumber"; }
textBox = Interlude.Input.TextBox(label=code_block.out0, defaultValue=code_block.out1, placeholder=code_block.out2, key=code_block.out3)
code_block_2 = CodeBlock { "^[A-Z]-\\d{3}$"; "Like A-101"; false; }
regex = Interlude.Rule.Regex(pattern=code_block_2.out0, message=code_block_2.out1, ignoreCase=code_block_2.out2)
code_block_3 = CodeBlock(item0=regex) { [item0]; }
withValidation = Interlude.Behavior.WithValidation(element=textBox, rule=code_block_3)

# group: Show it
# trigger is false so the graph runs without opening the dialog: every field comes back with its default and buttonClicked reads "skipped". Set it to true to see the form.
string = StringInput("Rename views")
code_block_4 = CodeBlock(field=withValidation) { [field]; }
boolean = BoolSelector(false)
show = Interlude.Form.Show(title=string, elements=code_block_4, trigger=boolean)
string_2 = StringInput("sheetNumber")

# group: Keep it as a document
# Form.Create builds the same form without showing it, and Form.ToJson writes it out. A form saved this way can be reviewed, diffed and loaded again with Form.FromJson.
create = Interlude.Form.Create(title=string, elements=code_block_4)
toJson = Interlude.Form.ToJson(form=create)

# group: Read the answer
# Answers come back keyed by the field's key, whatever the form looked like.
getString = Interlude.Result.GetString(result=show.form, key=string_2)
