# Dynamo graph Interlude.Theme.Create.dyn (Dynamo 4.2.0.5752)
# Interlude.Theme.Create: a theme built port by port.
# packages: Interlude 1.0.5

# group: Describe the field
# What the form holds, built left to right: literals into a code block, the code block into a node, and the nodes gathered into the list Form.Show takes.
code_block = CodeBlock { "Project name"; "Tower A"; "As it appears on the drawing"; "projectName"; }
textBox = Interlude.Input.TextBox(label=code_block.out0, defaultValue=code_block.out1, placeholder=code_block.out2, key=code_block.out3)
code_block_2 = CodeBlock { "Discipline"; ["ARC","STR","MEP"]; ["Architectural","Structural","Services"]; "STR"; "Pick one"; "discipline"; }
dropDown = Interlude.Input.DropDown(label=code_block_2.out0, items=code_block_2.out1, displayNames=code_block_2.out2, defaultValue=code_block_2.out3, placeholder=code_block_2.out4, key=code_block_2.out5)
code_block_3 = CodeBlock { "Include basement"; true; "includeBasement"; }
checkBox = Interlude.Input.CheckBox(label=code_block_3.out0, defaultValue=code_block_3.out1, key=code_block_3.out2)
code_block_4 = CodeBlock(child0=textBox, child1=dropDown, child2=checkBox) { [child0,child1,child2]; }
code_block_5 = CodeBlock { 8.0; }
column = Interlude.Layout.Column(elements=code_block_4, spacing=code_block_5)

# group: Dress it
# Where the named themes stop. Everything has a default, so wiring one port changes one thing — this sets a compact density and rounder corners and leaves the rest alone. labelWidth is the one to reach for when a form's labels wrap.
code_block_6 = CodeBlock { "Light"; "#7CB342"; "Compact"; 10.0; 13.0; ""; 150.0; false; }
create = Interlude.Theme.Create(mode=code_block_6.out0, accent=code_block_6.out1, density=code_block_6.out2, cornerRadius=code_block_6.out3, fontSize=code_block_6.out4, fontFamily=code_block_6.out5, labelWidth=code_block_6.out6, reducedMotion=code_block_6.out7)

# group: Show it
# trigger is false so the graph runs without opening the dialog: every field comes back with its default and buttonClicked reads "skipped". Set it to true to see the form.
string = StringInput("Site survey")
code_block_7 = CodeBlock(field=column) { [field]; }
boolean = BoolSelector(false)
show = Interlude.Form.Show(title=string, elements=code_block_7, trigger=boolean, theme=create)
string_2 = StringInput("projectName")

# group: Keep it as a document
# Form.Create builds the same form without showing it, and Form.ToJson writes it out. A form saved this way can be reviewed, diffed and loaded again with Form.FromJson.
create_2 = Interlude.Form.Create(title=string, elements=code_block_7, theme=create)
toJson = Interlude.Form.ToJson(form=create_2)

# group: Read the answer
# Answers come back keyed by the field's key, whatever the form looked like.
getString = Interlude.Result.GetString(result=show.form, key=string_2)
